# Grasshopper definition B1-Modelling_BlockShape_creator.gh (Grasshopper 1.0.8)
# plug-ins: Tunny, Heteroptera, treesloth01, Pufferfish, Anemone, Human, Parakeet, Dodo, LunchBox, Pancake, eleFront, TT Toolbox

# ----
# Step 2: Plotting all QMC results
# NB! The excel file must not be opened
qmc_excel_file_1 = Panel("C:\Users\KYC\OneDrive - NGI\Documents\PhD\Paper - Synthetic rock joint generation for ML\Figures\BlockShape_TernaryDiagram_QMC-8192.xlsx")
read_qmc_result_from_excel_1 = BooleanToggle(False)
panel = Panel("""value_x
value_y
alpha
beta""")
qmc_worksheet_number = Panel("1")
column_index_for_the_parameters_listed_t = Panel("""3
4
5
6""")  # "Column index for the parameters listed to the left"

# ----
# Block shape creator
# Developed by: Jessica Ka Yi Chiu
# 0. Rhino set-up
# 1. User inputs
# 2. Create block
# 3. Determine joint information
# 4. Determine block shape
# 5. Plot results to charts
# 6. Loop Excel / Read Excel to get joint orientations of selected blocks
# 7. Create layers in Rhino
# 8. Bake block geometry to charts and legend
# NGI Group Colour Palette
# Colour code:
# User input
# Pre-defined values
# 0. RHINO SET-UP
# 1. Open Rhino file: BlockShape_Playground_Template.3dm
# 2. Maximise Top view
# NGI Panel/Objects Colour Palette
# 1. USER INPUTS
# Choose a mode:
# 
# - "Run Tunny" - the sliders will be enabled for changing the 12 parameters with QMC sampling via Tunny
# - "Loop Excel" - the blocks will be reading from the 12 parameters, i.e. volume box size edge (XYZ) dimensions and face rotation.
# - "Retrieve individual block info from Excel" - user to specify an index to retrieve joint information and calculate P32.
# Mode: "Run Tunny"
mode = ValueList({"Run Tunny": 0, "Loop Excel": 1, "Retrieve individual block info from Excel": 2}, selected="Retrieve individual block info from Excel")

# ----
# When finished baking, set to False
set_bake_blocks_to_rhino_to_true = BooleanToggle(False)
bake_blocks_to_rhino = Button()

# ----
# Step 4: Bake blocks to Rhino
# 
# (Must set read excel [2] to True)
create_rhino_layers = Button()

# ---- group: Legend box grid divisions
v_divisions = Slider(2, range=0..10)
u_divisions = Slider(8, range=0..10)

# ----
# distinct colors generated with help of
# https://mokole.com/palette.html
customised_color_list = Panel("""#8b4513
#228b22
#808000
#483d8b
#008080
#4682b4
#000080
#8b008b
#b03060
#66cdaa
#ff0000
#ffa500
#ffff00
#00ff00
#8a2be2
#000000
#dc143c
#eee8aa
#adff2f
#ff7f50
#ff00ff
#1e90ff
#0000ff
#add8e6
#ff1493
#ee82ee
#98fb98
#ffc0cb""")

colour_picker = ColourPicker(PickedColour=RGB(0, 0, 0))
legend_text_size = Slider(2, range=0..10)
move_text_along_x_axis = Slider(-5.446, range=-10..10)

# ---- group: Read from Excel
file_path = FilePath(qmc_excel_file_1)
read_excel_sheet = ReadExcelSheet(Run=read_qmc_result_from_excel_1, FilePath=file_path, Worksheet=qmc_worksheet_number, Listen=False)  # -> UserMessages, Columns, Rows
tree_branch = TreeBranch(Tree=read_excel_sheet.Columns, Path=column_index_for_the_parameters_listed_t, MaintainPaths=True)
cull_index = CullIndex(List=tree_branch, Indices="0", Wrap=True)
explode_tree = ExplodeTree(Data=cull_index)  # -> flatten(Branch0), flatten(Branch1), flatten(Branch2), flatten(Branch3)

# ----
# Select point (Osnap) on chart in Rhino
c_chart_10_1 = Point(Point(186.681, -0.025, 0))
a_chart_1_0 = Point(Point(130.025, -107.625, 0))
b_chart_10_0 = Point(Point(243.325, -107.625, 0))
deconstruct = Deconstruct(Point=a_chart_1_0)  # -> XComponent, YComponent, ZComponent
deconstruct_2 = Deconstruct(Point=b_chart_10_0)  # -> XComponent, YComponent, ZComponent
deconstruct_3 = Deconstruct(Point=c_chart_10_1)  # -> XComponent, YComponent, ZComponent

# ----
# Select point (Osnap) on chart in Rhino
chart_1_1 = Point(Point(5.475, -76.525, 0))
chart_10_10 = Point(Point(62.528, -19.625, 0))

# ----
# Read QMC results from excel and plot on both charts
panel_2 = Panel("1")
panel_3 = Panel("1")

# ---- group: Plotting points below the graphs and blocks
point_elevations_z = Panel("-20")

# ---- group: Singh
qmc_alpha = Number(explode_tree.Branch2)
qmc_beta = Number(explode_tree.Branch3)
expression = Expression(alpha=qmc_alpha, Expression="If(alpha<0,0,if(alpha>10,10,alpha))")
expression_2 = Expression(
    alpha=expression,
    beta=qmc_beta,
    A_x=deconstruct.XComponent,
    B_x=deconstruct_2.XComponent,
    C_x=deconstruct_3.XComponent,
    Expression="(1-beta)*((1-log10(alpha))*A_x+log10(alpha)*B_x)+beta*C_x")
expression_3 = Expression(
    alpha=expression,
    beta=qmc_beta,
    A_y=deconstruct.YComponent,
    B_y=deconstruct_2.YComponent,
    C_y=deconstruct_3.YComponent,
    Expression="(1-beta)*((1-log10(alpha))*A_y+log10(alpha)*B_y)+beta*C_y")
construct_point = ConstructPoint(XCoordinate=expression_2, YCoordinate=expression_3, ZCoordinate=point_elevations_z)

# ----
# Mode "Retrieve individual block info from Excel"
# Step 4: Calculate P32 of each joint set
# one-by-one for each selected block
# 
# (Must set read excel [2] to True)
list_of_bounding_box_edge_length_m = Panel("""5
10
15
20
25
30
35
40
45
50
55
60
65
70
75
80
85
90
95
100""")
p32_calculation = BooleanToggle(False)
block_index = Panel("2")

# ----
# Mode: "Loop Excel"
# Step 3: Acquire selected block orientation and spacing
# 
# Select block shape for DFN generation, save to a new worksheet/ workbook [2]
# Determine joint information (orientation, spacing) of all selected blocks
# NB! The excel file must not be opened
# Parameter list: Param S1_Deg1
# Param S1_Deg2
# Param S1_Deg3
# Param S2_Deg1
# Param S2_Deg2
# Param S2_Deg3
# Param S3_Deg1
# Param S3_Deg2
# Param S3_Deg3
# Param X
# Param Y
# Param Z
selected_block_excel_file_path_2 = Panel("C:\Users\KYC\OneDrive - NGI\Documents\PhD\Paper - Synthetic rock joint generation for ML\Figures\BlockShape_TernaryDiagram_QMC-8192.xlsx")
worksheet_number = Panel("4")
run_excel_loop_for_block_information = Button()
read_excel_2_for_block_information_and_n = BooleanToggle(True)  # "Read excel [2] for block information and names"
column_index_for_the_parameters_listed_t_2 = Panel("""8
9
10
11
12
13
14
15
16
17
18
19""")  # "Column index for the parameters listed to the left"

# ----
# (Optional: Bake points to charts)
singh_et_al_points = Point(construct_point)

legend_box_lower_righ = Panel("{120,-113,0}")
# Legend box dimension setting
legend_box_upper_left = Panel("{0,-98,0}")
ignored_block_index = Panel("15")

# ---- group: Create grid points
legend_box_upper_left_point = Point(legend_box_upper_left)
legend_box_lower_right_point = Point(legend_box_lower_righ)
legend_box_u_division = Integer(u_divisions)
legend_box_v_division = Integer(v_divisions)
point = Point([legend_box_upper_left_point, legend_box_lower_right_point])
bounding_rectangle = BoundingRectangle(Geometry=point, Plane=PlaneXY(0, 0, 0), Axis=0, Slide=0, Union=True)  # -> Bounding, DimensionX, DimensionY
grid_structure = GridStructure(Surface=bounding_rectangle.Bounding, UDivisions=legend_box_u_division, VDivisions=legend_box_v_division)  # -> StructureLines, StructureNodes
list_length = ListLength(List=grid_structure.StructureNodes)
no_of_grid_points = Integer(list_length)

# ----
no_of_grid_points_2 = Panel(no_of_grid_points)

# ---- group: Sort first based by descending Y, then by ascending X
deconstruct_4 = Deconstruct(Point=grid_structure.StructureNodes)  # -> XComponent, YComponent, ZComponent
negative = Negative(Value=deconstruct_4.YComponent)
multi_sort = MultiSort(
    Key0=negative,
    Key1=deconstruct_4.XComponent,
    Data0=grid_structure.StructureNodes,
    FirstValueIndex=2,
    LastSaveLocalization="neutral,N")  # -> Key0, Key1, Data0

# ---- group: Insert null to ignored block index
dummy_coordinate = Panel("{0,100,0}")
ignored_block_index_2 = Integer(ignored_block_index)
insert_items = InsertItems(List=multi_sort.Data0, Item=dummy_coordinate, Indices=ignored_block_index_2, Wrap=True)

# ---- group: Check sorted point order
point_list = PointList(Points=multi_sort.Data0)

# ----
# Legend block name setting
unit_x = UnitX(Factor=move_text_along_x_axis)

# ----
# Rotate Face 0 & 2
panel_4 = Panel("""0
2""")
s1_deg1 = TunnyValueList({"-30", "-15", "0", "15", "30"}, selected="0")
s1_deg2 = TunnyValueList({"-30", "-15", "0", "15", "30"}, selected="15")
s1_deg3 = TunnyValueList({"-30", "-15", "0", "15", "30"}, selected="0")

# ----
# Rotate Face 4 & 5
panel_5 = Panel("""4
5""")
s3_deg1 = TunnyValueList({"-30", "-15", "0", "15", "30"}, selected="-30")
s3_deg2 = TunnyValueList({"-30", "-15", "0", "15", "30"}, selected="30")
s3_deg3 = TunnyValueList({"-30", "-15", "0", "15", "30"}, selected="0")

# ----
# Create volume box
X = Slider(1, range=0.1..4)
Y = Slider(1, range=0.1..4)
Z = Slider(1, range=0.1..4)

# ----
# Rotate Face 1 & 3
panel_6 = Panel("""1
3""")
s2_deg1 = TunnyValueList({"-30", "-15", "0", "15", "30"}, selected="15")
s2_deg2 = TunnyValueList({"-30", "-15", "0", "15", "30"}, selected="-30")
s2_deg3 = TunnyValueList({"-30", "-15", "0", "15", "30"}, selected="30")

# ----
# Step 1: QMC sampling
# 
# Conduct QMC sampling with Tunny, export results as csv from Dashboard, convert csv to an excel file [1]
variables = Relay([X, Y, Z, s1_deg1, s1_deg2, s1_deg3, s2_deg1, s2_deg2, s2_deg3, s3_deg1, s3_deg2, s3_deg3])

# ---- group: Joint orientation and spacing results
# Mode "Loop Excel" or "Retrieve individual block info from Excell"
# Determine joint orientation and spacing
# Write as JointSet#-Dip/DipDirection
panel_7 = Panel("1")
joint_set = Panel("""S1
S2
S3""")

# ----
# Create solid from block faces
number_slider = Slider(1000, range=0..1000)

# ---- group: Loop - P32 Calculation
list_length_2 = ListLength(List=list_of_bounding_box_edge_length_m)
loop_start = LoopStart(Repeat=list_length_2, Trigger=p32_calculation)  # -> port, Counter, Data
list_item = ListItem(List=list_of_bounding_box_edge_length_m, Index=loop_start.Counter, Wrap=invert(True))

# ----
p32_calculation_counter = Panel(loop_start.Counter)

# ---- group: Create Bounding Box with different edge length parameters
division = Division(A=list_item, B="2")
negative_2 = Negative(Value=division)
construct_domain = ConstructDomain(DomainStart=negative_2, DomainEnd=division)

# ----
# Plot single block on Palmström 1995 Chart (A3-31)
deconstruct_5 = Deconstruct(Point=chart_1_1)  # -> XComponent, YComponent, ZComponent
deconstruct_6 = Deconstruct(Point=chart_10_10)  # -> XComponent, YComponent, ZComponent
subtraction = Subtraction(A=deconstruct_6.XComponent, B=deconstruct_5.XComponent)
subtraction_2 = Subtraction(A=deconstruct_6.YComponent, B=deconstruct_5.YComponent)

# ---- group: Palmström
qmc_y = Number(explode_tree.Branch1)
qmc_x = Number(explode_tree.Branch0)
smaller_than = SmallerThan(FirstNumber=qmc_y, SecondNumber="20")  # -> SmallerThan, OrEqualTo
cull_pattern = CullPattern(List=qmc_x, CullPattern=smaller_than.OrEqualTo)
cull_pattern_2 = CullPattern(List=qmc_y, CullPattern=smaller_than.OrEqualTo)
expression_4 = Expression(
    value_x=cull_pattern,
    x_diff_log10=subtraction,
    x_log1=deconstruct_5.XComponent,
    Expression="(log10(value_x)*x_diff_log10)+x_log1")
expression_5 = Expression(
    value_y=cull_pattern_2,
    y_diff_log10=subtraction_2,
    y_log1=deconstruct_5.YComponent,
    Expression="(log10(value_y)*y_diff_log10)+y_log1")
construct_point_2 = ConstructPoint(XCoordinate=expression_4, YCoordinate=expression_5, ZCoordinate=point_elevations_z)

# ----
palmström_points = Point(construct_point_2)

# ----
# Create a rectangular grid to make the block legend
block_legend_point_list = Point(insert_items)

move = Move(Geometry=block_legend_point_list, Motion=unit_x)  # -> Geometry, Transform

# ----
# 8. BAKE BLOCK GEOMETRY TO CHARTS AND LEGEND
panel_8 = Panel("Block_")

# ----
# 6. LOOP EXCEL/READ EXCEL TO
# GET JOINT ORIENTATIONS OF SELECTED BLOCKS
file_path_2 = FilePath(selected_block_excel_file_path_2)
read_excel_sheet_2 = ReadExcelSheet(Run=read_excel_2_for_block_information_and_n, FilePath=file_path_2, Worksheet=worksheet_number, Listen=False)  # -> UserMessages, Columns, Rows
tree_branch_2 = TreeBranch(Tree=read_excel_sheet_2.Columns, Path=column_index_for_the_parameters_listed_t_2, MaintainPaths=False)
entwine = Entwine(
    Branch00=s1_deg1,
    Branch01=s1_deg2,
    Branch02=s1_deg3,
    Branch03=s2_deg1,
    Branch04=s2_deg2,
    Branch05=s2_deg3,
    Branch06=s3_deg1,
    Branch07=s3_deg2,
    Branch08=s3_deg3,
    Branch09=X,
    Branch010=Y,
    Branch011=Z,
    FlattenInputs=True)  # -> simplify(Result)

# ---- group: Remove header
panel_9 = Panel("0")
cull_index_2 = CullIndex(List=read_excel_sheet_2.Columns, Indices=panel_9, Wrap=True)  # -> simplify(List)

# ----
list_item_2 = ListItem(List=tree_branch_2, Index=panel_9, Wrap=True)
panel_10 = Panel(list_item_2)
tree_branch_3 = TreeBranch(Tree=cull_index_2, Path=column_index_for_the_parameters_listed_t_2, MaintainPaths=False)
list_length_3 = ListLength(List=tree_branch_3)
first_last = FirstLast(List=flatten(list_length_3))  # -> FirstValue, LastValue
loop_start_2 = LoopStart(Repeat=first_last.FirstValue, Trigger=bake_blocks_to_rhino)  # -> port, Counter, Data
list_item_3 = ListItem(List=tree_branch_3, Index=loop_start_2.Counter, Wrap=invert(True))
list_item_4 = ListItem(List=tree_branch_3, Index=block_index, Wrap=invert(True))
stream_filter = StreamFilter(Gate=mode, Stream0=entwine, Stream1=list_item_3, Stream2=list_item_4)
explode_tree_2 = ExplodeTree(Data=stream_filter)  # -> Branch0, Branch1, Branch2, Branch3, Branch4, Branch5, Branch6, Branch7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

loop_counter = Panel(loop_start_2.Counter)

constrained_volume_box = ConstrainedVolumeBox(
    Plane=PlaneXY(0, 0, 0),
    Volume="5",
    FactorX=explode_tree_2.Branch9,
    FactorY=explode_tree_2.Branch10,
    FactorZ=explode_tree_2.Branch11)  # -> Box, DimensionX, DimensionY, DimensionZ

# ----
# 2. CREATE BLOCK
deconstruct_brep = DeconstructBrep(Brep=constrained_volume_box.Box)  # -> Faces, Edges, Vertices

list_item_5 = ListItem(List=deconstruct_brep.Faces, Index=panel_4, Wrap=True)
first_last_2 = FirstLast(List=list_item_5)  # -> FirstValue, LastValue
area = Area(Geometry=list_item_5)  # -> Area, Centroid
is_planar = IsPlanar(Surface=first_last_2.FirstValue, Interior=True)  # -> Planar, Plane
plane_origin = PlaneOrigin(Base=is_planar.Plane, Origin=area.Centroid)
rotate_world = RotateWorld(
    Geometry=list_item_5,
    Plane=plane_origin,
    Axis1=0,
    Axis2=1,
    Axis3=2,
    Degrees1=explode_tree_2.Branch0,
    Degrees2=explode_tree_2.Branch1,
    Degrees3=explode_tree_2.Branch2)  # -> Rotated, Plane1, Plane2, Plane3, Transform
brep_0_2 = Brep(rotate_world.Rotated)

list_item_6 = ListItem(List=deconstruct_brep.Faces, Index=panel_5, Wrap=True)
first_last_3 = FirstLast(List=list_item_6)  # -> FirstValue, LastValue
area_2 = Area(Geometry=list_item_6)  # -> Area, Centroid
is_planar_2 = IsPlanar(Surface=first_last_3.FirstValue, Interior=True)  # -> Planar, Plane
plane_origin_2 = PlaneOrigin(Base=is_planar_2.Plane, Origin=area_2.Centroid)
rotate_world_2 = RotateWorld(
    Geometry=list_item_6,
    Plane=plane_origin_2,
    Axis1=0,
    Axis2=1,
    Axis3=2,
    Degrees1=explode_tree_2.Branch6,
    Degrees2=explode_tree_2.Branch7,
    Degrees3=explode_tree_2.Branch8)  # -> Rotated, Plane1, Plane2, Plane3, Transform
brep_4_5 = Brep(rotate_world_2.Rotated)

list_item_7 = ListItem(List=deconstruct_brep.Faces, Index=panel_6, Wrap=True)
first_last_4 = FirstLast(List=list_item_7)  # -> FirstValue, LastValue
area_3 = Area(Geometry=list_item_7)  # -> Area, Centroid
is_planar_3 = IsPlanar(Surface=first_last_4.FirstValue, Interior=True)  # -> Planar, Plane
plane_origin_3 = PlaneOrigin(Base=is_planar_3.Plane, Origin=area_3.Centroid)
rotate_world_3 = RotateWorld(
    Geometry=list_item_7,
    Plane=plane_origin_3,
    Axis1=0,
    Axis2=1,
    Axis3=2,
    Degrees1=explode_tree_2.Branch3,
    Degrees2=explode_tree_2.Branch4,
    Degrees3=explode_tree_2.Branch5)  # -> Rotated, Plane1, Plane2, Plane3, Transform
brep_1_3 = Brep(rotate_world_3.Rotated)

merge = Merge(Data1=brep_0_2, Data2=brep_1_3, Data3=brep_4_5)
area_4 = Area(Geometry=merge)  # -> Area, Centroid
scale = Scale(Geometry=merge, Center=area_4.Centroid, Factor=number_slider)  # -> Geometry, Transform
createsolid = CreateSolid(Breps=scale.Geometry)
volume = Volume(Geometry=createsolid)  # -> Volume, Centroid
bounding_box = BoundingBox(Content=createsolid, Plane=PlaneXY(0, 0, 0), UnionBox=True)  # -> Box, Box_2
panel_11 = Panel(volume.Volume)
box_properties = BoxProperties(Box=bounding_box.Box)  # -> Center, Diagonal, Area, Volume, Degeneracy

# ----
# Determine block shape based on Singh et al. 2022
# 5. PLOT RESULTS TO CHARTS
block_shape_singh_2022 = Block_shape_Singh_2022(brep=createsolid)  # -> alpha_2, beta_final_2

# ----
# Plot single block on Singh et al. 2022 Chart
beta = EleFrontDataDescription(block_shape_singh_2022.beta_final_2, ShiftDepth=0, isNameSet=True)
alpha = EleFrontDataDescription(block_shape_singh_2022.alpha_2, ShiftDepth=0, isNameSet=True)
expression_6 = Expression(
    alpha=alpha,
    beta=beta,
    A_x=deconstruct.XComponent,
    B_x=deconstruct_2.XComponent,
    C_x=deconstruct_3.XComponent,
    Expression="(1-beta)*((1-log10(alpha))*A_x+log10(alpha)*B_x)+beta*C_x")
expression_7 = Expression(
    alpha=alpha,
    beta=beta,
    A_y=deconstruct.YComponent,
    B_y=deconstruct_2.YComponent,
    C_y=deconstruct_3.YComponent,
    Expression="(1-beta)*((1-log10(alpha))*A_y+log10(alpha)*B_y)+beta*C_y")
alpha_2 = Panel(alpha)
beta_2 = Panel(beta)
construct_point_3 = ConstructPoint(XCoordinate=expression_6, YCoordinate=expression_7, ZCoordinate=0)
vector_2pt = Vector2Pt(PointA=box_properties.Center, PointB=construct_point_3, Unitize=False)  # -> Vector, Length
move_2 = Move(Geometry=createsolid, Motion=vector_2pt.Vector)  # -> Geometry, Transform
brep_wireframe = BrepWireframe(Brep=move_2.Geometry, Density=-1)

list_item_8 = ListItem(List=block_legend_point_list, Index=loop_start_2.Counter, Wrap=True)

# ---- group: Move block to legend positions
vector_2pt_2 = Vector2Pt(PointA=box_properties.Center, PointB=list_item_8, Unitize=False)  # -> Vector, Length
move_3 = Move(Geometry=createsolid, Motion=vector_2pt_2.Vector)  # -> Geometry, Transform

# ---- group: Get block identifier
tree_branch_4 = TreeBranch(Tree=cull_index_2, Path="1", MaintainPaths=True)
list_item_9 = ListItem(List=tree_branch_4, Index=loop_start_2.Counter, Wrap=invert(True))

# ----
text_tag_3d = TextTag3D(Location=move.Geometry, Text=tree_branch_4, Size=legend_text_size, Colour=colour_picker, Justification=4)

# ----
# 7. CREATE LAYERS IN RHINO
concatenate = Concatenate(FragmentA=panel_8, FragmentB=tree_branch_4)
create_layers = CreateLayers(CreateToggle=create_rhino_layers, LayerNames=concatenate, LayerColors=customised_color_list)

construct_fish_attribute = ConstructFishAttribute(Volume=volume.Volume)

alpha_3 = Number(block_shape_singh_2022.alpha_2)
beta_3 = Number(block_shape_singh_2022.beta_final_2)

# ----
# Determine unique face ID and spacing
deconstruct_brep_2 = DeconstructBrep(Brep=createsolid)  # -> Faces, Edges, Vertices

# ---- group: Get all not intersection face pairs
brep_brep = BrepBrep(BrepA=simplify(graft(deconstruct_brep_2.Faces)), BrepB=deconstruct_brep_2.Faces)  # -> simplify(Curves), Points
list_length_4 = ListLength(List=brep_brep.Curves)
trim_tree = TrimTree(Tree=list_length_4, Depth=1)
list_indices = ListIndices(List=trim_tree)
cull_pattern_3 = CullPattern(List=list_indices, CullPattern=invert(trim_tree))
sort_list = SortList(Keys=cull_pattern_3)  # -> Keys, ValuesValuesA

# ----
# 3. DETERMINE JOINT INFORMATION
is_planar_4 = IsPlanar(Surface=deconstruct_brep_2.Faces, Interior=True)  # -> Planar, Plane

first_last_5 = FirstLast(List=sort_list.Keys)  # -> FirstValue, LastValue
count_unique = CountUnique(Key=flatten(first_last_5.FirstValue), SortIfPossible=False, LastSaveLocalization="neutral,N")  # -> KeyList, Count
unique_face_id_1 = Integer(count_unique.KeyList)

# ---- group: Determine joint spacing
list_item_10 = ListItem(List=deconstruct_brep_2.Faces, Index=unique_face_id_1, Wrap=True)
area_5 = Area(Geometry=list_item_10)  # -> Area, Centroid

# ----
count_unique_2 = CountUnique(Key=flatten(first_last_5.LastValue), SortIfPossible=False, LastSaveLocalization="neutral,N")  # -> KeyList, Count
unique_face_id_2 = Integer(count_unique_2.KeyList)

# ---- group: Determine joint spacing (continued)
list_item_11 = ListItem(List=is_planar_4.Plane, Index=unique_face_id_2, Wrap=True)
plane_closest_point = PlaneClosestPoint(Point=area_5.Centroid, Plane=list_item_11)  # -> Point, UVPoint, Distance
absolute = Absolute(Value=plane_closest_point.Distance)

# ----
face_joint_spacing_m = Number(absolute)

# ---- group: Joint orientation and spacing results (continued)
round_to_decimal_place = RoundToDecimalPlace(NumberX=face_joint_spacing_m, DecimalPlace="2", RoundType=0)  # -> Rounded, Difference
spacing = Panel(round_to_decimal_place.Rounded)

# ---- group: Construct Prep Frame perpendicular to joint faces
list_item_12 = ListItem(List=deconstruct_brep_2.Faces, Index=unique_face_id_1, Wrap=True)

# ---- group: Joint orientation and spacing results (continued)
mesh_dip_dipdirection = MeshDipDipDirection(mesh=list_item_12, round_to_nearest=invert(False), no_of_decimal_place=panel_7)  # -> dip_deg_2, dip_direction_deg_2, dip_dipdirection_2
joint_orientation = Panel(mesh_dip_dipdirection.dip_dipdirection_2)
merge_2 = Merge(Data1=simplify(graft(joint_set)), Data2=simplify(graft(joint_orientation)), Data3=simplify(graft(spacing)))
text_join = TextJoin(Text=merge_2, Join="-")
text_join_2 = TextJoin(Text=flatten(text_join), Join=";")
individual_block_joint_orientation_and_s = Panel(text_join_2)  # "Individual block joint orientation and spacing result"
results_text = Text(text_join_2)

# ----
results_text_2 = Text(results_text)
loop_end = LoopEnd(port=loop_start_2.port, Exit=False, Data=results_text_2, TimeOutVal=0, pausedState=False, state="Last & Record")

# ----
# Right-click > Copy Data Only, then paste to excel file
loop_excel_joint_orientation_and_spacing = Panel(loop_end)  # "Loop excel joint orientation and spacing results"

# ----
# Mode "Retrieve individual block info from Excell"
# Deteremine P32 based on different bounding box edge lengths
vector_2pt_3 = Vector2Pt(PointA=area_5.Centroid, PointB=plane_closest_point.Point, Unitize=invert(False))  # -> Vector, Length

# ---- group: Construct Prep Frame perpendicular to joint faces (continued)
reverse = Reverse(Vector=vector_2pt_3.Vector)
line_sdl = LineSDL(Start=area_5.Centroid, Direction=vector_2pt_3.Vector, Length="100")
line_sdl_2 = LineSDL(Start=area_5.Centroid, Direction=reverse, Length="100")
end_points = EndPoints(Curve=line_sdl)  # -> Start, End
end_points_2 = EndPoints(Curve=line_sdl_2)  # -> Start, End
line = Line(StartPoint=end_points.End, EndPoint=end_points_2.End)
divide_length = DivideLength(Curve=line, Length=face_joint_spacing_m)  # -> Points, Tangents, simplify(Parameters)
perp_frame = PerpFrame(Curve=simplify(graft(line)), Parameter=divide_length.Parameters)

# ---- group: find center point of Bounding Box
merge_3 = Merge(Data1=end_points.Start, Data2=end_points_2.Start)
average = Average(Input=merge_3)
xy_plane = XYPlane(Origin=average)

# ---- group: Create Bounding Box with different edge length parameters (continued)
domain_box = DomainBox(Base=xy_plane, X=construct_domain, Y=construct_domain, Z=construct_domain)

# ---- group: Calculate P32
brep_plane = BrepPlane(Brep=domain_box, Plane=perp_frame)  # -> Curves, Points
brep = Brep(brep_plane.Curves)
trim_tree_2 = TrimTree(Tree=brep, Depth="1")
area_6 = Area(Geometry=trim_tree_2)  # -> Area, Centroid
mass_addition = MassAddition(Input=area_6.Area)  # -> flatten(Result), PartialResults
volume_2 = Volume(Geometry=domain_box)  # -> Volume, Centroid
division_2 = Division(A=mass_addition.Result, B=volume_2.Volume)
p32 = Number(division_2)

# ---- group: Loop - P32 Calculation (continued)
loop_end_2 = LoopEnd(port=loop_start.port, Exit=invert(p32_calculation), Data=p32, TimeOutVal=0, pausedState=False, state="Constant & Record")
list_item_13 = ListItem(List=loop_end_2, Index="0", Wrap=True)
s1_p32 = Number(list_item_13)
s2_p32 = Number(list_item_13)
list_item_14 = ListItem(List=loop_end_2, Index="1", Wrap=True)
list_item_15 = ListItem(List=loop_end_2, Index="2", Wrap=True)
s3_p32 = Number(list_item_13)

# ----
# Right-click > Copy Data Only,
# then paste to a another excel file [3]
# for determining the converged P32
s1_p32_2 = Panel(s1_p32)
s2_p32_2 = Panel(s2_p32)
s3_p32_2 = Panel(s3_p32)

panel_12 = Panel(volume_2.Volume)

# ----
# 4. DETERMINE BLOCK SHAPE
# Determine block shape based on Palmström 1995
deconstruct_brep_3 = DeconstructBrep(Brep=createsolid)  # -> Faces, Edges, Vertices
length = Length(Curve=deconstruct_brep_3.Edges)
count_unique_3 = CountUnique(Key=length, SortIfPossible=False, LastSaveLocalization="neutral,N")  # -> KeyList, Count
statistics = Statistics(Series=count_unique_3.KeyList)  # -> SampleMean, Median, Average, StandardDeviation, Skewness, Kurtosis, Variance
min_max = MinMax(Number=count_unique_3.KeyList)  # -> Minimum, Maximum
expression_8 = Expression(S_max=min_max.Maximum, S_min=min_max.Minimum, Expression="S_max/S_min")
expression_9 = Expression(S_mid=statistics.Median, S_min=min_max.Minimum, Expression="S_mid/S_min")

tree_statistics = TreeStatistics(Tree=createsolid)  # -> Paths, Length, Count
duplicate_data = DuplicateData(Data=simplify(graft(tree_statistics.Paths)), Number=simplify(graft(tree_statistics.Length)), Order=True)  # -> flatten(Data)
create_tree = CreateTree(Data=expression_8, Path=duplicate_data)
create_tree_2 = CreateTree(Data=expression_9, Path=duplicate_data)
value_x = Number(create_tree)
value_y = Number(create_tree_2)

# ----
# Results
value_x_2 = Number(value_x)
value_y_2 = Number(value_y)

tunny = Tunny(
    Variables=[X, Y, Z, s1_deg1, s1_deg2, s1_deg3, s2_deg1, s2_deg2, s2_deg3, s3_deg1, s3_deg2, s3_deg3],
    Objectives=[value_x_2, value_y_2, alpha_3, beta_3],
    Attributes=construct_fish_attribute)  # -> Info, Fishes
objectives = Relay([value_x_2, value_y_2, alpha_3, beta_3])

expression_10 = Expression(
    value_x=value_x,
    x_diff_log10=subtraction,
    x_log1=deconstruct_5.XComponent,
    Expression="(log10(value_x)*x_diff_log10)+x_log1")
expression_11 = Expression(
    value_y=value_y,
    y_diff_log10=subtraction_2,
    y_log1=deconstruct_5.YComponent,
    Expression="(log10(value_y)*y_diff_log10)+y_log1")
construct_point_4 = ConstructPoint(XCoordinate=expression_10, YCoordinate=expression_11, ZCoordinate=0)
vector_2pt_4 = Vector2Pt(PointA=box_properties.Center, PointB=construct_point_4, Unitize=False)  # -> Vector, Length
move_4 = Move(Geometry=createsolid, Motion=vector_2pt_4.Vector)  # -> Geometry, Transform
brep_wireframe_2 = BrepWireframe(Brep=move_4.Geometry, Density=-1)

value_y_3 = Panel(value_y)
value_x_3 = Panel(value_x)

concatenate_2 = Concatenate(FragmentA=panel_8, FragmentB=list_item_9)
list_item_16 = ListItem(List=customised_color_list, Index=loop_start_2.Counter, Wrap=True)
panel_13 = Panel(concatenate_2)
createattributes = CreateAttributes(Name=panel_13, LayerName=concatenate_2, Color=list_item_16, PlotColor=list_item_16, enableFullPath=False)
bake_geometry = BakeGeometry(
    Bake=set_bake_blocks_to_rhino_to_true,
    Geometry=[move_4.Geometry, move_2.Geometry, move_3.Geometry],
    Attributes=createattributes,
    DeleteOldBakes=False,
    PreserveTrees=False)

# ==== cluster MeshDipDipDirection: Calculate dip and direction of mesh

# ---- group: Inputs
mesh = ClusterInput()
round_to_nearest = ClusterInput()
no_of_decimal_place = ClusterInput()
round_to_nearest_2 = Boolean(round_to_nearest)
no_of_decimal_place_2 = Integer(no_of_decimal_place)
mesh_2 = Mesh(mesh)

# ---- group: Get arithmetic mean of normal for each mesh
face_normals = FaceNormals(Mesh=mesh_2)  # -> Centers, Normals
average = Average(Input=face_normals.Normals)  # -> flatten(ArithmeticMean)

# ---- group: Obtain horisontal components; ensure vector length greater than zero
deconstruct_vector = DeconstructVector(Vector=average)  # -> XComponent, YComponent, ZComponent
vector_xyz = VectorXYZ(XComponent=deconstruct_vector.XComponent, YComponent=deconstruct_vector.YComponent, ZComponent=0)  # -> Vector, Length
vector_length = VectorLength(Vector=vector_xyz.Vector)
dup = DuplicateDataMatch(SourceDataTree=vector_xyz.Vector, SecondaryDataSecondaryData1="{0,1,0}")  # -> SourceData, SecondaryDataSecondaryData1
equality = Equality(FirstNumber=vector_length, SecondNumber="0")  # -> Equality, Inequality
pick_n_choose = PickNChoose(Pattern=equality.Equality, Stream0=vector_xyz.Vector, Stream1=<missing>)

# ---- group: Dip direction calculation
larger_than = LargerThan(FirstNumber=deconstruct_vector.ZComponent, SecondNumber="0")  # -> LargerThan, OrEqualTo
reverse = Reverse(Vector=pick_n_choose)
pick_n_choose_2 = PickNChoose(Pattern=larger_than.LargerThan, Stream0=reverse, Stream1=pick_n_choose)
unit_y = UnitY(Factor=1)
deconstruct_vector_2 = DeconstructVector(Vector=pick_n_choose_2)  # -> XComponent, YComponent, ZComponent
larger_than_2 = LargerThan(FirstNumber=deconstruct_vector_2.XComponent, SecondNumber="0")  # -> LargerThan, OrEqualTo
angle = Angle(VectorA=unit_y, VectorB=pick_n_choose_2)  # -> Angle, Reflex
pick_n_choose_3 = PickNChoose(Pattern=larger_than_2.LargerThan, Stream0=angle.Reflex, Stream1=angle.Angle)
degrees = Degrees(Radians=pick_n_choose_3)
addition = Addition(A=degrees)

# ---- group: Dip angle calculation
angle_2 = Angle(VectorA=pick_n_choose, VectorB=average)  # -> Angle, Reflex
degrees_2 = Degrees(Radians=angle_2.Angle)
subtraction = Subtraction(A="90", B=degrees_2)
absolute = Absolute(Value=subtraction)

# ---- group: Dip: Replace with null if null; rounding
null_item = NullItem(Item=degrees_2)  # -> NullFlags, InvalidFlags, Description
round_to_decimal_place = RoundToDecimalPlace(NumberX=absolute, DecimalPlace=no_of_decimal_place_2, RoundType=0)  # -> Rounded, Difference
list_indices = ListIndices(List=null_item.NullFlags)
cull_pattern = CullPattern(List=list_indices, CullPattern=null_item.NullFlags)
replace_items = ReplaceItems(List=absolute, Indices=cull_pattern, Wrap=False)
replace_items_2 = ReplaceItems(List=round_to_decimal_place.Rounded, Indices=cull_pattern, Wrap=False)
stream_filter = StreamFilter(Gate=round_to_nearest_2, Stream0=replace_items, Stream1=replace_items_2)

# ---- group: Dip Direction: Replace with null if null; rounding
null_item_2 = NullItem(Item=degrees_2)  # -> NullFlags, InvalidFlags, Description
round_to_decimal_place_2 = RoundToDecimalPlace(NumberX=addition, DecimalPlace=no_of_decimal_place_2, RoundType=0)  # -> Rounded, Difference
list_indices_2 = ListIndices(List=null_item_2.NullFlags)
cull_pattern_2 = CullPattern(List=list_indices_2, CullPattern=null_item_2.NullFlags)
replace_items_3 = ReplaceItems(List=round_to_decimal_place_2.Rounded, Indices=cull_pattern_2, Wrap=False)
replace_items_4 = ReplaceItems(List=degrees, Indices=cull_pattern_2, Wrap=False)
stream_filter_2 = StreamFilter(Gate=round_to_nearest_2, Stream0=replace_items_4, Stream1=replace_items_3)

# ---- group: Output-numeric
dip_deg = Number(stream_filter)
dip_direction_deg = Number(stream_filter_2)
dip_deg_2 = ClusterOutput(dip_deg)
dip_direction_deg_2 = ClusterOutput(dip_direction_deg)

# ---- group: Output-text
concatenate = Concatenate(Fragment_A=dip_deg, A="/", Fragment_B=dip_direction_deg)
dip_dipdirection = Text(concatenate)
dip_dipdirection_2 = ClusterOutput(dip_dipdirection)

# ==== cluster Block_shape_Singh_2022
brep = ClusterInput()
# Refernece:
# Singh, J. et al. (2022) ‘Modified block shape characterization method for classification of fractured rock: A python-based GUI tool’, Computers & Geosciences, 164, p. 105125. Available at: https://doi.org/10.1016/j.cageo.2022.105125.
brep_2 = Brep(brep)
# Calculation of alpha
deconstruct_brep = DeconstructBrep(Brep=brep_2)  # -> Faces, Edges, Vertices
interconnectpoints = InterconnectPoints(Pts=deconstruct_brep.Vertices)
# Calculation of beta
vector = Vector(interconnectpoints)
length = Length(Curve=interconnectpoints)

# ----
# Find longest chord
list_indices = ListIndices(List=interconnectpoints)
sort_list = SortList(Keys=length, ValuesValuesA=list_indices)  # -> reverse(Keys), reverse(ValuesValuesA)
first_last = FirstLast(List=sort_list.ValuesValuesA)  # -> FirstValue, LastValue
longest_chord_index = Integer(first_last.FirstValue)
list_item = ListItem(List=interconnectpoints, Index=longest_chord_index, Wrap=True)

chord_length = Number(length)
end_points = EndPoints(Curve=list_item)  # -> Start, End
amplitude = Amplitude(Vector=vector, Amplitude=chord_length)
volume = Volume(Geometry=brep_2)  # -> Volume, Centroid
area = Area(Geometry=deconstruct_brep.Faces)  # -> Area, Centroid
chord_length_2 = Number(length)
mass_addition = MassAddition(Input=area.Area)  # -> Result, PartialResults
statistics = Statistics(Series=chord_length_2)  # -> SampleMean, Median, Average, StandardDeviation, Skewness, Kurtosis, Variance
l_med = Number(statistics.Median)
l_med_2 = Number(l_med)
larger_than = LargerThan(FirstNumber=chord_length, SecondNumber=l_med_2)  # -> LargerThan, OrEqualTo

# ---- group: Remove longest chord from the lsit
replace_items = ReplaceItems(List=larger_than.OrEqualTo, Item="False", Indices=longest_chord_index, Wrap=False)

# ---- group: Chords longer than median
cull_pattern = CullPattern(List=interconnectpoints, CullPattern=larger_than.OrEqualTo)

# ---- group: Group A
curve_closest_point = CurveClosestPoint(Point=end_points.Start, Curve=cull_pattern)  # -> Point, Parameter, Distance
equality_within_tolerance = EqualityWithinTolerance(FirstNumber=curve_closest_point.Distance, SecondNumber="0", Tolerance=0.01)  # -> Equality, Inequality
cull_pattern_2 = CullPattern(List=cull_pattern, CullPattern=equality_within_tolerance.Equality)

# ---- group: Group B
curve_closest_point_2 = CurveClosestPoint(Point=end_points.End, Curve=cull_pattern)  # -> Point, Parameter, Distance
equality_within_tolerance_2 = EqualityWithinTolerance(FirstNumber=curve_closest_point_2.Distance, SecondNumber="0", Tolerance=0.01)  # -> Equality, Inequality
cull_pattern_3 = CullPattern(List=cull_pattern, CullPattern=equality_within_tolerance_2.Equality)

# ----
panel = Panel(mass_addition.Result)
tree_statistics = TreeStatistics(Tree=brep_2)  # -> Paths, Length, Count
expression = Expression(
    A_s=flatten(mass_addition.Result),
    l_avg=flatten(statistics.Average),
    V=flatten(volume.Volume),
    Expression="(A_s*l_avg)/(7.7*V)")

# ---- group: Calculate Group A Beta
group_a_curves = Curve(cull_pattern_2)
cross_reference = CrossReference(ListListA=group_a_curves, ListListB=group_a_curves, CrossMode=2)  # -> ListListA, ListListB
angle = Angle(VectorA=cross_reference.ListListA, VectorB=cross_reference.ListListB)  # -> Angle, Reflex
expression_2 = Expression(angle=angle.Angle, Expression="(cos(angle))²")
min_max = MinMax(Number=expression_2)  # -> Minimum, Maximum
smallest_beta_groupa = Number(min_max.Minimum)

# ----
list_item_2 = ListItem(List=amplitude, Index=longest_chord_index, Wrap=True)

# ---- group: Calculate Group B Beta
group_b_curves = Curve(cull_pattern_3)
cross_reference_2 = CrossReference(ListListA=group_b_curves, ListListB=group_b_curves, CrossMode=2)  # -> ListListA, ListListB
angle_2 = Angle(VectorA=cross_reference_2.ListListA, VectorB=cross_reference_2.ListListB)  # -> Angle, Reflex
expression_3 = Expression(angle=angle_2.Angle, Expression="(cos(angle))²")
min_max_2 = MinMax(Number=expression_3)  # -> Minimum, Maximum
smallest_beta_groupb = Number(min_max_2.Minimum)

# ----
duplicate_data = DuplicateData(Data=simplify(graft(tree_statistics.Paths)), Number=simplify(graft(tree_statistics.Length)), Order=True)  # -> flatten(Data)
longest_chord_vector = Vector(list_item_2)
create_tree = CreateTree(Data=expression, Path=duplicate_data)
alpha = Number(create_tree)
alpha_2 = ClusterOutput(alpha)
expression_4 = Expression(
    Beta_1=flatten(smallest_beta_groupa),
    Beta_2=flatten(smallest_beta_groupb),
    Expression="(2*Beta_1*Beta_2)/(Beta_1+Beta_2)")
create_tree_2 = CreateTree(Data=expression_4, Path=duplicate_data)
beta_final = Number(create_tree_2)
beta_final_2 = ClusterOutput(beta_final)
