# Grasshopper definition B2-Modelling_slope_rough_surface.gh (Grasshopper 1.0.8)
# plug-ins: Pufferfish, CockroachGH, Noise 4D, Pancake, Wombat

# ----
# 1. USER INPUTS
# Button to click through file list
click_once = Button()
save_stl = Button()
perlin_noise_scale = Slider(0.2, range=0..10)
stl_suffix = Panel("_PerlinSurface.stl")
# Slope rough surface (using Perlin Noise)
# Developed by: Jessica Ka Yi Chiu
# 1. User inputs
# 2. Create list of identifiers
# 3. Manually go through file list based on identifisers' list
# 4. Get the largest Sub-mesh
# 5. Apply Perlin noise
# 6. Export Perlin surface to one level above the input directory
# Colour code:
# User input
file_path_for_socketed_slope_surface_obj = Panel("C:\Users\KYC\Downloads\DFN_gen?\DFN_gen?_socketed_slope.obj")  # "File path for socketed slope surface (OBJ), put ? as identifier"
populate_geometry_count_perlin_noise_res = Slider(10000, range=0..10000)  # "Populate geometry count (Perlin Noise resolution)"
not_used_identifier_indices = Panel("""0
16""")
number_range_from_0_to = Panel("11")
number_of_alphabets = Panel("17")

# ----
# 5. APPLY PERLIN NOISE
perlin_noise_scale_2 = Number(perlin_noise_scale)
populate_geometry_count = Number(populate_geometry_count_perlin_noise_res)

# ----
# 6. EXPORT PERLIN SURFACE TO ONE LEVEL ABOVE THE INPUT DIRECTORY
stl_suffix_2 = Text(stl_suffix)
null_values = NullValues(LastSaveLocalization="neutral,N")  # -> Null, NaN, Infinity, Infinity_2

# ----
# 2. CREATE LIST OF IDENTIFIERS
number_of_alphabets_2 = Integer(number_of_alphabets)
number_range_from_0_to_2 = Integer(number_range_from_0_to)
range = Range(Domain=number_range_from_0_to_2, Steps=number_range_from_0_to_2)
char_sequence = CharSequence(Count=number_of_alphabets_2, CharPool="ABCDEFGHIJKLMNOPQRSTUVWXYZ", Format="{0}")
not_used_identifier_indices_2 = Integer(not_used_identifier_indices)
merge = Merge(Data1=range, Data2=char_sequence)  # -> flatten(Result)

# ----
# Pre-defined values
full_identifier_list = Panel(merge)

# ---- group: Remove not-used identifiers
cull_index = CullIndex(List=merge, Indices=not_used_identifier_indices_2, Wrap=True)

# ----
# Results
culled_identifier_list = Panel(cull_index)

# ----
# 3. MANUALLY GO THROUGH FILE LIST BASED ON IDENTIFIERS' LIST
data_recorder = DataRecorder(click_once, DataLimit=100, RecordData=True)
replace_text = ReplaceText(Text=file_path_for_socketed_slope_surface_obj, Find="?", Replace=cull_index, RecursiveReplace=False)
last_index = LastIndex(List=flatten(data_recorder))  # -> expr("Max(0, (x-1)\2)", Index)
panel = Panel(last_index)
list_item = ListItem(List=replace_text, Index=panel, Wrap=True)
panel_2 = Panel(list_item)
socketed_slope_file_path = FilePath(list_item)

# ---- group: Get the sub-mesh with the largest number of faces
# 4. GET THE LARGEST SUB-MESH
socketed_slope_file_path_2 = FilePath(socketed_slope_file_path)
import_obj = ImportOBJ(File=socketed_slope_file_path_2, MapYtoZ=False, LastSaveLocalization="neutral,N")
deconstruct_mesh = DeconstructMesh(Mesh=import_obj)  # -> Vertices, Faces, Colours, Normals
list_length = ListLength(List=deconstruct_mesh.Faces)  # -> flatten(Length)
list_indices = ListIndices(List=list_length)
sort_list = SortList(Keys=list_length, ValuesA=list_indices)  # -> Keys, ValuesA
last_index_2 = LastIndex(List=sort_list.ValuesA)
list_item_2 = ListItem(List=import_obj, Index=last_index_2, Wrap=True)
socketed_slope_mesh = Mesh(list_item_2)

# ----
socketed_slope_mesh_2 = Mesh(socketed_slope_mesh)
populate_geometry = PopulateGeometry(Geometry=socketed_slope_mesh_2, Count=populate_geometry_count, Seed=1)
populatemesh = PopulateMesh(Mesh=socketed_slope_mesh_2, N=populate_geometry_count, Type=0)
panel_3 = Panel(populatemesh)
cloudexplode = CloudExplode(PointCloud=populatemesh)  # -> Points, Normals, Colors
perlinnoise = PerlinNoise(Values=populate_geometry, Time=0, Scale=perlin_noise_scale_2)
mesh_closest_point = MeshClosestPoint(Point=populate_geometry, Mesh=socketed_slope_mesh_2)  # -> Point, Index, Parameter
mesh_eval = MeshEval(Mesh=socketed_slope_mesh_2, Parameter=mesh_closest_point.Parameter)  # -> Point, Normal, Colour
amplitude = Amplitude(Vector=mesh_eval.Normal, Amplitude=perlinnoise)
move = Move(Geometry=populate_geometry, Motion=amplitude)  # -> Geometry, Transform
perlin_noise_points = Point(move.Geometry)

panel_4 = Panel(cull_index)

perlin_noise_points_2 = Point(perlin_noise_points)
directory_from_file_path = DirectoryFromFilePath(FilePath=socketed_slope_file_path_2)
panel_5 = Panel(directory_from_file_path)
concatenate = Concatenate(FragmentA=directory_from_file_path, FragmentB=stl_suffix_2)
panel_6 = Panel(concatenate)

# ----
# Preview:
# PerlinSurface
delaunay_mesh = DelaunayMesh(Points=flatten(perlin_noise_points_2), Plane=null_values.Null)

export_stl = ExportSTL(
    Mesh=delaunay_mesh,
    Relocate=False,
    SavePath=panel_6,
    SaveAsBinaryFile=True,
    SaveNow=save_stl,
    LastSaveLocalization="neutral,N")

stl_exported = Panel(export_stl)
