# Grasshopper definition C-Modelling_synthetic_box_dataset_single_texture.gh (Grasshopper 1.0.8)
# Copyright: 2022
# plug-ins: RhinoCodePluginGH, Pufferfish, Anemone, Human, MetaHopper

# ----
# Synthetic box dataset with single texture
# Developed by: Jessica Ka Yi Chiu
# 1. User inputs
# 2. Box modelling
# 3. Joint modelling
# 4. Jointed rock mass modelling
# 5. Camera positioning
# 6, Custom preview setting
# 7. Photo-shooting & image export loop
# Colour code:
# User input
# 1. USER INPUTS
# Step 1: CHECK RHINO DOCUMENT DISTANCE TOLERANCE
# Make sure distance tolerance = 0.001
# If not, in Rhino Interface, go to File > Properties > Unit > Set Absolute Tolerance = 0.001 m
document_distance_tolerance = DocumentDistanceTolerance()
# Results
# Pre-defined values
panel = Panel(document_distance_tolerance)

# ----
# Step 2: FILE INPUT
texture_jpg_file_path = Panel("C:\Users\KYC\OneDrive - NGI\Documents\PhD\Paper - Synthetic rock joint generation for ML\Textures\rock_boulder_dry_4k.blend\textures\rock_boulder_dry_diff_4k.jpg")

# ----
# Step 3: ASSIGN OPENING BETWEEN BOXES
# Simulate rock joint aperture
box_gap_m = Panel("0.01")

# ---- group: Rock domain & slope face mesh / added aperture (m) for each dimension
panel_2 = Panel("1.19")
panel_3 = Panel("1.21")
panel_4 = Panel("0.79")

# ---- group: Rock domain & slope face mesh
center = Panel("{0,0,2}")
xy_plane = XYPlane(Origin=center)
center_box = CenterBox(Base=xy_plane, X=panel_2, Y=panel_3, Z=panel_4)
brep = Brep(center_box)

# ---- group: Joint brep
yz_plane = YZPlane(Origin=center)
xz_plane = XZPlane(Origin=center)
# 2. BOX MODELLING
xy_plane_2 = XYPlane(Origin=center)
merge = Merge(Data1=xy_plane_2, Data2=xz_plane, Data3=yz_plane)  # -> simplify(graft(Result))
brep_plane = BrepPlane(Brep=brep, Plane=merge)  # -> Curves, Points
joint_brep = Brep(flatten(brep_plane.Curves))

# ---- group: Rock domain & slope face mesh / Splitting breps
explode_tree = ExplodeTree(Data=graft(joint_brep))  # -> Branch0, Branch1, Branch2
split_brep = SplitBrep(Brep=brep, Cutter=explode_tree.Branch0)
cap_holes = CapHoles(Brep=split_brep)
split_brep_2 = SplitBrep(Brep=cap_holes, Cutter=explode_tree.Branch1)
cap_holes_2 = CapHoles(Brep=split_brep_2)
split_brep_3 = SplitBrep(Brep=cap_holes_2, Cutter=explode_tree.Branch2)
cap_holes_3 = CapHoles(Brep=split_brep_3)  # -> flatten(Brep)
list_item = ListItem(List=cap_holes_3, Index="0", Wrap=True)
brep_to_be_removed = Brep(list_item)
solid_difference = SolidDifference(BrepsA=brep, BrepsB=brep_to_be_removed)
rock_brep = Brep(solid_difference)

# ----
# Create bounding box
bounding_box = BoundingBox(Content=rock_brep, Plane=PlaneXY(0, 0, 0), UnionBox=True)  # -> Box, Box_2
volume = Volume(Geometry=bounding_box.Box)  # -> Volume, Centroid

# ---- group: JPG
file_path = FilePath(texture_jpg_file_path)

# ----
# Step 4: RENDERING
# Set solid white background:
# In the specific viewport, go to Display Options > in the specific Display Mode > Set ground plane setting off
camera_distance_m = Slider(7, range=0..500)
perspective_camera_projection = BooleanToggle(True)
camera_lens_length = Panel("50")
vector_star_steps = Slider(5, range=0..10)
rhino_viewport_name = Panel("Perspective")
rhino_display_mode = Panel("Rendered")
image_export_file_directory = Panel("C:\Users\KYC\Downloads\Benchmark-rock_boulder_dry-20241118")
subfolder_directory_names = Panel("""\rockmass\
\label\
""")
file_format = Panel(".png")

# ----
# Step 5: IMAGE EXPORT
# Set the desired width and height of Viewport in Rhino before looping and exporting the images
# NB! Re-writable!
object_visualisation = ValueList({"Rock Mass": 0, "Rock joint annotations": 1}, selected="Rock Mass")
loop_image = BooleanToggle(False)
export_image_nb_set_loop_image_to_true = BooleanToggle(False)

# ----
# 6. CUSTOM PREVIEW SETTINGS
panel_5 = Panel("White")
# 7. PHOTO-SHOOTING & IMAGE EXPORT LOOP
panel_6 = Panel("0")
create_material = CreateMaterial(Diffuse=panel_5, Specular=panel_5, Emission=panel_5, Transparency="0", Shine="0")
create_material_2 = CreateMaterial(Diffuse="Black", Specular="Black", Emission="Black", Transparency=panel_6, Shine=panel_6)
object_visualisation_0_rockmass_1_label = Panel(object_visualisation)

# ----
# Output file settings
export_image_boolean = Boolean(export_image_nb_set_loop_image_to_true)
list_item_2 = ListItem(SubfolderDirectoryNames=subfolder_directory_names, Index=object_visualisation_0_rockmass_1_label, Wrap=True)
concatenate = Concatenate(Image_export_file_directory=image_export_file_directory, B=list_item_2, file_format=file_format)
output_file_path = FilePath(concatenate)

# ---- group: Run Rhino command to export viewport
ironpython_2_script = IronPython2Script(file_path=concatenate, run=export_image_boolean)  # -> out, a; inputs viewport_name: String, file_path: String, run: Boolean
# ---------- ironpython_2_script: IronPython ----------
import rhinoscriptsyntax as rs

def capture_viewport(file_path, run, viewport_name):
    if run:
        # Ensure the file path is properly formatted
        formatted_path = '"' + file_path + '"'
        # Activate the specified viewport
        rs.CurrentView(viewport_name)
        # Construct the command string
        command = '-_ViewCaptureToFile {} _Enter'.format(formatted_path)
        # Run the command
        rs.Command(command, True)

# Inputs from Grasshopper
capture_viewport(file_path, run, viewport_name)
# ---------- end ironpython_2_script ----------

# ----
output_file_name = Panel(output_file_path)

# ----
# 3. JOINT MODELLING
max_waviness_amplitude_m = Panel("0")
uv_spacing_m = Panel("0.5")
joint_brep_2 = Brep(flatten(joint_brep))
cluster = Cluster(
    joint_brep=joint_brep_2,
    max_amplitude_m=max_waviness_amplitude_m,
    uv_spacing_m=uv_spacing_m,
    min_aperture_m=box_gap_m,
    max_aperture_m=box_gap_m)  # -> wavy_joint_solid_2, trimmed_wavy_joint_surface_3
joint_brep_3 = Brep(cluster.wavy_joint_solid_2)

# ----
# 4. JOINTED ROCK MASS MODELLING
rock_brep_2 = Brep(rock_brep)
joint_brep_4 = Brep(joint_brep_3)
solid_difference_2 = SolidDifference(BrepsA=rock_brep_2, BrepsB=joint_brep_4)
jointed_rock_mass_solids = Brep(solid_difference_2)

# ---- group: Remove joint brep with removed box
solid_difference_3 = SolidDifference(BrepsA=cluster.wavy_joint_solid_2, BrepsB=brep_to_be_removed)

# ----
cleaned_joint_brep = Brep(solid_difference_3)

custom_preview = CustomPreview(Geometry=cleaned_joint_brep, Material=create_material_2)
custom_preview_2 = CustomPreview(Geometry=jointed_rock_mass_solids, Material=create_material)
hide_show_object_preview = HideShowObjectPreview(Visible=object_visualisation_0_rockmass_1_label, AllObjects_Object=[custom_preview, custom_preview_2])

custom_preview_materials = CustomPreviewMaterials(Geometry=jointed_rock_mass_solids, DiffuseColor=RGB(255, 255, 255), DiffuseBitmap=file_path)
hide_show_object_preview_2 = HideShowObjectPreview(Visible=invert(object_visualisation_0_rockmass_1_label), AllObjects_Object=custom_preview_materials)

# ----
# Vector star around object to create camera positions
camera_target_centroid = Point(volume.Centroid)
value_list = ValueList({"Cubic": 0, "Spherical": 1}, selected="Cubic")
xy_plane_3 = XYPlane(Origin=camera_target_centroid)
vector_star = VectorStar(Plane=xy_plane_3, Steps=vector_star_steps, SubdivisionType=value_list, Dimensionality=False)  # -> Vectors, Lines

# ----
# Remove camera direction from below the slope
camara_distance_m = Number(camera_distance_m)
amplitude = Amplitude(Vector=vector_star.Vectors, Amplitude=camara_distance_m)
evaluate_box = EvaluateBox(Box=bounding_box.Box, UParameter=0.5, VParameter=0.5, WParameter="0")  # -> Plane, Point, Include
move = Move(Geometry=camera_target_centroid, Motion=amplitude)  # -> Geometry, Transform
point_plane_side = PointPlaneSide(Point=move.Geometry, Plane=evaluate_box.Plane)  # -> Side, Front, Back, Distance
cull_pattern = CullPattern(List=move.Geometry, CullPattern=point_plane_side.Front)

list_length = ListLength(List=cull_pattern)
duplicate_data = DuplicateData(Data=camera_target_centroid, Number=list_length, Order=True)

# ----
# 5. CAMERA POSITIONING
camera_locations = Point(cull_pattern)
camera_targets = Point(duplicate_data)

# ---- group: Loop
# Loop & progress
list_length_2 = ListLength(List=camera_locations)
loop_image_boolean = Boolean(loop_image)
invert_boolean = InvertBoolean(Boolean=loop_image_boolean)  # -> Inverted, Number
loop_start = LoopStart(Repeat=list_length_2, Trigger=loop_image_boolean, Data="-1")  # -> port, Counter, Data
addition = Addition(A=loop_start.Data, B="1")
running = Running(
    port=loop_start.port,
    Exit=invert_boolean.Inverted,
    Data=addition,
    TimeOutVal=0,
    pausedState=False,
    state="Constant output")

# ----
check_total_number_of_image_output = Panel(list_length_2)

# ----
# Viewport settings
list_item_3 = ListItem(List=camera_targets, Index=loop_start.Data, Wrap=invert(True))
list_item_4 = ListItem(List=camera_locations, Index=loop_start.Data, Wrap=invert(True))
modify_viewport = ModifyViewport(
    ViewportName=rhino_viewport_name,
    DisplayMode=rhino_display_mode,
    CameraLocation=list_item_4,
    CameraTarget=list_item_3,
    CameraProjection=perspective_camera_projection,
    CameraLensLength=camera_lens_length,
    AnimateRestore=False,
    RestoreFrames=10)

# ---- group: Progress print
multiplication = Multiplication(A=loop_image_boolean, B=running)
concatenate_2 = Concatenate(Fragment_A="Progress: ", B=multiplication, A=" of ", Fragment_B=list_length_2)

# ----
image_export_progress = Panel(concatenate_2)

# ==== cluster Cluster
uv_spacing_m = ClusterInput()
max_amplitude_m = ClusterInput()
min_aperture_m = ClusterInput()
joint_brep = ClusterInput()
max_aperture_m = ClusterInput()
uv_spacing_m_2 = Number(uv_spacing_m)
min_aperture_m_2 = Number(min_aperture_m)
max_aperture_m_2 = Number(max_aperture_m)
max_amplitude_m_2 = Number(max_amplitude_m)
joint_brep_2 = Brep(joint_brep)
area = Area(Geometry=joint_brep_2)  # -> Area, Centroid
point_list = PointList(Points=area.Centroid, Size="2")

# ----
# 4. Extrude joint boundary to form cutter
max_amplitude_m_3 = Number(max_amplitude_m_2)
joint_brep_3 = Brep(joint_brep_2)
deconstruct_brep = DeconstructBrep(Brep=joint_brep_3)  # -> Faces, Edges, simplify(Vertices)
number = Number(max_amplitude_m_3)
expression = Expression(a=number, Expression="If(a>0, a*4, 1)")
expression_2 = Expression(a=number, Expression="If(a>0, a*-2, -0.5)")

# ---- group: Randomise aperture values
construct_domain = ConstructDomain(DomainStart=min_aperture_m_2, DomainEnd=max_aperture_m_2)

# ----
# 3. Create wavy rectangular surface
max_amplitude_m_4 = Number(max_amplitude_m_2)
negative = Negative(Value=max_amplitude_m_4)
construct_domain_2 = ConstructDomain(DomainStart=negative, DomainEnd=max_amplitude_m_4)

# ----
# 1. Create rectangle surface and distribute seed points
joint_brep_4 = Brep(joint_brep_2)
is_planar = IsPlanar(Surface=joint_brep_4, Interior=True)  # -> Planar, Plane
bounding_rectangle = BoundingRectangle(Geometry=simplify(graft(joint_brep_4)), Plane=simplify(graft(is_planar.Plane)), Axis=0, Slide=0, Union=invert(True))  # -> simplify(Bounding), simplify(DimensionX), simplify(DimensionY)
joint_plane = Plane(is_planar.Plane)

joint_plane_2 = Plane(joint_plane)
deconstruct_plane = DeconstructPlane(Plane=joint_plane_2)  # -> Origin, XAxis, YAxis, simplify(graft(ZAxis))
convex_hull = ConvexHull(Points=deconstruct_brep.Vertices, Plane=simplify(graft(joint_plane_2)))  # -> Hull, HullZ, Indices
amplitude = Amplitude(Vector=simplify(graft(deconstruct_plane.ZAxis)), Amplitude=expression_2)
amplitude_2 = Amplitude(Vector=simplify(graft(deconstruct_plane.ZAxis)), Amplitude=expression)
move = Move(Geometry=simplify(graft(convex_hull.Hull)), Motion=amplitude)  # -> Geometry, Transform
extrude = Extrude(Base=simplify(graft(move.Geometry)), Direction=amplitude_2)
extruded_joint_boundary = Brep(extrude)

# ---- group: Randomise aperture values (continued)
list_length = ListLength(List=joint_brep_4)
random = Random(Range=construct_domain, Number=list_length, Seed="42")

# ----
expression_3 = Expression(x=flatten(bounding_rectangle.DimensionX), spacing=uv_spacing_m_2, Expression="x/spacing")
expression_4 = Expression(x=flatten(bounding_rectangle.DimensionY), spacing=uv_spacing_m_2, Expression="x/spacing")

divide_surface = DivideSurface(Surface=bounding_rectangle.Bounding, UCount=simplify(graft(expression_3)), VCount=simplify(graft(expression_4)))  # -> Points, Normals, Parameters

# ----
# 5. Trim rectangular wavy surface with joint boundary
cutter = Brep(extruded_joint_boundary)
cap_holes = CapHoles(Brep=cutter)

# ----
# 6. Extrude trimmed wavy surface with aperture to closed brep
joint_plane_3 = Plane(is_planar.Plane)
deconstruct_plane_2 = DeconstructPlane(Plane=joint_plane_3)  # -> Origin, XAxis, YAxis, ZAxis
amplitude_3 = Amplitude(Vector=deconstruct_plane_2.ZAxis, Amplitude=random)

rectangle_joint_brep = Brep(bounding_rectangle.Bounding)
trim_tree = TrimTree(Tree=divide_surface.Points, Depth=1)  # -> simplify(Tree)
trim_tree_2 = TrimTree(Tree=divide_surface.Normals, Depth=1)  # -> simplify(Tree)
list_length_2 = ListLength(List=trim_tree)
random_2 = Random(Range=construct_domain_2, Number=list_length_2, Seed="42")  # -> simplify(Random)
amplitude_4 = Amplitude(Vector=trim_tree_2, Amplitude=random_2)
addition = Addition(A=expression_3, B="1")  # -> simplify(graft(Result))
move_2 = Move(Geometry=trim_tree, Motion=amplitude_4)  # -> Geometry, Transform

# ---- group: Only deform surface if tree branch not empty
tree_statistics = TreeStatistics(Tree=move_2.Geometry)  # -> Paths, Length, Count
tree_branch = TreeBranch(Tree=addition, Path=tree_statistics.Paths, MaintainPaths=True)

# ---- group: surface too small for UV division
list_indices = ListIndices(List=joint_brep_4)
deconstruct_path = DeconstructPath(Branch=tree_statistics.Paths)  # -> flatten(Indices)
cull_index = CullIndex(List=list_indices, Indices=deconstruct_path, Wrap=True)
tree_branch_2 = TreeBranch(Tree=bounding_rectangle.Bounding, Path=cull_index, MaintainPaths=True)

# ----
surface_from_points = SurfaceFromPoints(Points=move_2.Geometry, UCount=tree_branch, Interpolate=invert(False))

merge = Merge(Data1=surface_from_points, Data2=tree_branch_2)

wavy_rect_surface = Brep(merge)

wavy_rect_surface_2 = Brep(wavy_rect_surface)
split_brep = SplitBrep(Brep=wavy_rect_surface_2, Cutter=cutter)  # -> simplify(Result)
area_2 = Area(Geometry=split_brep)  # -> Area, Centroid
point_in_brep = PointInBrep(Brep=cap_holes, Point=area_2.Centroid, Strict=True)
cull_pattern = CullPattern(List=split_brep, CullPattern=point_in_brep)
trimmed_wavy_joint_surface = Brep(flatten(cull_pattern))

trimmed_wavy_joint_surface_2 = Brep(flatten(trimmed_wavy_joint_surface))
extrude_2 = Extrude(Base=flatten(trimmed_wavy_joint_surface_2), Direction=amplitude_3)
wavy_joint_solid = Brep(extrude_2)

trimmed_wavy_joint_surface_3 = ClusterOutput(trimmed_wavy_joint_surface_2)
wavy_joint_solid_2 = ClusterOutput(wavy_joint_solid)
