# Grasshopper definition D-Calculation_BlockShape.gh (Grasshopper 1.0.8)
# plug-ins: Heteroptera, Pufferfish, Anemone, Dodo, LunchBox, Pancake, eleFront, Wombat

# ----
# Step 2: Plotting all QMC results
# NB! The excel file must not be opened
# QMC excel file [1]: C:\Users\KYC\OneDrive - NGI\Documents\PhD\Paper - Synthetic rock joint generation for ML\Figures\BlockShape_TernaryDiagram_QMC-8192.xlsx
read_qmc_result_from_excel_1 = BooleanToggle(False)
panel = Panel("""value_x
value_y
alpha
beta""")
qmc_worksheet_number = Panel("1")
column_index_for_the_parameters_listed_t = Panel("""3
4
5
6""")  # "Column index for the parameters listed to the left"

# ---- group: Legend box grid divisions
v_divisions = Slider(2, range=0..10)
u_divisions = Slider(8, range=0..10)

# ----
legend_box_lower_righ = Panel("{120,-113,0}")
# Legend box dimension setting
legend_box_upper_left = Panel("{0,-98,0}")
ignored_block_index = Panel("15")

# ----
# (Optional: Bake points to charts)
palmström_points = Point()
singh_et_al_points = Point()

# ----
# NGI Group Colour Palette
# NGI Panel/Objects Colour Palette
panel_2 = Panel("""1
2
3
4
5
6
7
8
9
10
11
A
B
C
D
F
G
H
I
J
K
L
M
N
O
P
Q""")

legend_text_size = Slider(2, range=0..10)
move_text_along_x_axis = Slider(-5.446, range=-10..10)

# ----
# 4. DETERMINE BLOCK SHAPE
panel_3 = Panel("0")

# ----
# Legend block name setting
unit_x = UnitX(Factor=move_text_along_x_axis)
move = Move(Motion=unit_x)  # -> Geometry, Transform
text_tag_3d = TextTag3D(Location=move.Geometry, Size=legend_text_size, Justification=4)

# ---- group: Create grid points
legend_box_upper_left_point = Point()
legend_box_lower_right_point = Point()
legend_box_u_division = Integer()
legend_box_v_division = Integer()
point = Point([legend_box_upper_left_point, legend_box_lower_right_point])
bounding_rectangle = BoundingRectangle(Geometry=point, Plane=PlaneXY(0, 0, 0), Axis=0, Slide=0, Union=True)  # -> Bounding, DimensionX, DimensionY
grid_structure = GridStructure(Surface=bounding_rectangle.Bounding, UDivisions=legend_box_u_division, VDivisions=legend_box_v_division)  # -> StructureLines, StructureNodes
list_length = ListLength(List=grid_structure.StructureNodes)
no_of_grid_points = Integer(list_length)

# ----
# Plot single block on Singh et al. 2022 Chart
# Select point (Osnap) on chart in Rhino
c_chart_10_1 = Point(Point(186.681, -0.025, 0))
a_chart_1_0 = Point(Point(130.025, -107.625, 0))
b_chart_10_0 = Point(Point(243.325, -107.625, 0))
deconstruct = Deconstruct(Point=a_chart_1_0)  # -> XComponent, YComponent, ZComponent
deconstruct_2 = Deconstruct(Point=b_chart_10_0)  # -> XComponent, YComponent, ZComponent
deconstruct_3 = Deconstruct(Point=c_chart_10_1)  # -> XComponent, YComponent, ZComponent

# ----
# Plot single block on Palmström 1995 Chart (A3-31)
# Select point (Osnap) on chart in Rhino
chart_1_1 = Point(Point(5.475, -76.525, 0))
chart_10_10 = Point(Point(62.528, -19.625, 0))
deconstruct_4 = Deconstruct(Point=chart_1_1)  # -> XComponent, YComponent, ZComponent
deconstruct_5 = Deconstruct(Point=chart_10_10)  # -> XComponent, YComponent, ZComponent
subtraction = Subtraction(A=deconstruct_5.XComponent, B=deconstruct_4.XComponent)
subtraction_2 = Subtraction(A=deconstruct_5.YComponent, B=deconstruct_4.YComponent)

# ---- group: Sort first based by descending Y, then by ascending X
deconstruct_6 = Deconstruct(Point=grid_structure.StructureNodes)  # -> XComponent, YComponent, ZComponent
negative = Negative(Value=deconstruct_6.YComponent)
multi_sort = MultiSort(
    Key0=negative,
    Key1=deconstruct_6.XComponent,
    Data0=grid_structure.StructureNodes,
    FirstValueIndex=2,
    LastSaveLocalization="neutral,N")  # -> Key0, Key1, Data0

# ---- group: Insert null to ignored block index
dummy_coordinate = Panel("{0,100,0}")
ignored_block_index_2 = Integer()
insert_items = InsertItems(List=multi_sort.Data0, Item=dummy_coordinate, Indices=ignored_block_index_2, Wrap=True)

# ----
# Create a rectangular grid to make the block legend
block_legend_point_list = Point(insert_items)
list_item = ListItem(List=block_legend_point_list, Index=0, Wrap=True)

# ---- group: Move block to legend positions
vector_2pt = Vector2Pt(PointB=list_item, Unitize=False)  # -> Vector, Length
move_2 = Move(Motion=vector_2pt.Vector)  # -> Geometry, Transform

# ---- group: Check sorted point order
point_list = PointList(Points=multi_sort.Data0)

# ---- group: Plotting points below the graphs and blocks
point_elevations_z = Panel("-20")

# ----
colour_picker = ColourPicker(PickedColour=RGBA(0, 0, 0, 15))
panel_4 = Panel("C:\Users\KYC\OneDrive - NGI\Documents\PhD\Paper - Synthetic rock joint generation for ML\Figures\DFN_GEN_BlockShapePlots\DFN_Gen?_BlockShapePlots.png")
symbol_simple = SymbolSimple(Style=3, Size=12, Rotation=0, Colour=RGB(255, 105, 180))
symbol_display = SymbolDisplay(Display=symbol_simple)
rhino_command = RhinoCommand(SendCommandToggle=Button(), CommandString="_ViewCaptureToFile")

# ----
# Block shape calculations
# Developed by: Jessica Ka Yi Chiu
# Colour code:
# User input
# NB! Each calculation process can take 1-2 minutes!
# Loop & write to Excel
list_length_2 = ListLength(List=panel_2)
boolean_toggle = BooleanToggle(False)
# Pre-defined values
loop_start = LoopStart(Repeat=list_length_2, Trigger=boolean_toggle)  # -> port, Counter, Data
panel_5 = Panel(loop_start.Counter)

stream_filter = StreamFilter(Gate=boolean_toggle, Stream1=loop_start.Counter)
# Doubleclick Me!
list_item_2 = ListItem(List=panel_2, Index=stream_filter, Wrap=True)
replace_text = ReplaceText(Text="C:\Users\KYC\Downloads\DFN_gen?\DFN_gen?_blocks.obj", Find="?", Replace=list_item_2, RecursiveReplace=False)
import_obj = ImportOBJ(File=replace_text, MapYtoZ=False, LastSaveLocalization="neutral,N")

# ---- group: Sort geometry based on numberical keys
list_indices = ListIndices(List=import_obj)
# Results
sort_text = SortText(Keys=list_indices, Values=list_indices, Culture=127)  # -> Keys, Values

# ----
# Sort geometry based on numerical keys
replace_items = ReplaceItems(List=import_obj, Item=import_obj, Indices=sort_text.Values, Wrap=False)
object_id_sorted_blocks_obj = Geometry(replace_items)
list_indices_2 = ListIndices(List=object_id_sorted_blocks_obj)
object_id = Integer(list_indices_2)

mesh_to_polysurface = MeshToPolysurface(Mesh=object_id_sorted_blocks_obj, Triangles=False, FaceMerge=True)
is_polysurface_closed = IsPolysurfaceClosed(Polysurface=mesh_to_polysurface)
cull_pattern = CullPattern(List=mesh_to_polysurface, CullPattern=is_polysurface_closed)
brep = Brep(cull_pattern)
# PLOT RESULTS WITH
# with BlockShape_Playground_Template.3dm
volume = Volume(Geometry=brep)  # -> Volume, Centroid

# ----
# Determine block shape based on Singh et al. 2022
block_shape_singh_2022 = Block_shape_Singh_2022(brep=flatten(cull_pattern))  # -> alpha_2, beta_final_2
panel_6 = Panel(block_shape_singh_2022.beta_final_2)
panel_7 = Panel(block_shape_singh_2022.alpha_2)

tree_statistics = TreeStatistics(Tree=brep)  # -> Paths, Length, Count

cull_pattern_2 = CullPattern(List=object_id, CullPattern=is_polysurface_closed)
culled_object_id = Integer(cull_pattern_2)

duplicate_data = DuplicateData(Data=simplify(graft(tree_statistics.Paths)), Number=simplify(graft(tree_statistics.Length)), Order=True)  # -> flatten(Data)

# ----
# Determine block shape based on Palmström 1995
deconstruct_brep = DeconstructBrep(Brep=brep)  # -> Faces, Edges, Vertices
length = Length(Curve=deconstruct_brep.Edges)
count_unique = CountUnique(Key=length, SortIfPossible=False, LastSaveLocalization="neutral,N")  # -> KeyList, Count
statistics = Statistics(Series=count_unique.KeyList)  # -> SampleMean, Median, Average, StandardDeviation, Skewness, Kurtosis, Variance
min_max = MinMax(Number=count_unique.KeyList)  # -> Minimum, Maximum
expression = Expression(S_max=min_max.Maximum, S_min=min_max.Minimum, Expression="S_max/S_min")  # -> flatten(value_x)
expression_2 = Expression(S_mid=statistics.Median, S_min=min_max.Minimum, Expression="S_mid/S_min")  # -> flatten(value_y)

create_tree = CreateTree(Data=expression, Path=duplicate_data)
create_tree_2 = CreateTree(Data=expression_2, Path=duplicate_data)
value_x = Number(create_tree)
value_y = Number(create_tree_2)

# ----
# Write to excel
panel_8 = Panel("C:\Users\KYC\Downloads\DFN_BlockShape")
panel_9 = Panel("""DFN_Gen
Block_ID
value_x
value_y
alpha
beta
volume_m3""")
concatenate = Concatenate(FragmentA=panel_8, FragmentB="\DFN_?_BlockShape.xlsx")
list_length_3 = ListLength(List=cull_pattern)
replace_text_2 = ReplaceText(Text=concatenate, Find="?", Replace=list_item_2, RecursiveReplace=False)
duplicate_data_2 = DuplicateData(Data=list_item_2, Number=list_length_3, Order=True)
entwine = Entwine(
    Branch00=duplicate_data_2,
    Branch01=culled_object_id,
    Branch02=value_x,
    Branch03=value_y,
    Branch04=block_shape_singh_2022.alpha_2,
    Branch05=block_shape_singh_2022.beta_final_2,
    Branch06=volume.Volume,
    FlattenInputs=True)
excel_write = ExcelWrite(
    WriteExcelData=boolean_toggle,
    WorkbookPath=replace_text_2,
    WorksheetName="Sheet1",
    ColumnHeadings=panel_9,
    Data=entwine,
    ClearSheet=invert(False))

panel_10 = Panel(excel_write)
loop_end = LoopEnd(port=loop_start.port, Exit=False, Data=excel_write, TimeOutVal=0, pausedState=False, state="Constant output")

# ----
# 5. PLOT RESULTS TO CHARTS
# Read results from excel and plot on both charts
# 0 = DFN_Gen
# 1 = Block_ID
# 2 = value_x
# 3 = value_y
# 4 = alpha
# 5 = beta
# 6 = volume
read_all_excel_sheets = BooleanToggle(True)
replace_text_3 = ReplaceText(Text=concatenate, Find="?", Replace=panel_2, RecursiveReplace=False)
excel_reader = ExcelReader(ReadExcelData=read_all_excel_sheets, WorkbookPath=replace_text_3, WorksheetName="Sheet1")  # -> Exceptions, ExcelData
explode_tree = ExplodeTree(Data=excel_reader.ExcelData)  # -> Branch0, Branch1, Branch2, Branch3, Branch4, Branch5, Branch6

value_y_2 = Panel(value_y)
value_x_2 = Panel(value_x)

panel_13 = Panel(explode_tree.Branch6)

# ---- group: Palmström
y = Number(explode_tree.Branch3)
x = Number(explode_tree.Branch2)
smaller_than = SmallerThan(FirstNumber=y, SecondNumber="10000000")  # -> SmallerThan, OrEqualTo
cull_pattern_3 = CullPattern(List=x, CullPattern=smaller_than.OrEqualTo)
cull_pattern_4 = CullPattern(List=y, CullPattern=smaller_than.OrEqualTo)
expression_3 = Expression(
    value_x=cull_pattern_3,
    x_diff_log10=subtraction,
    x_log1=deconstruct_4.XComponent,
    Expression="(log10(value_x)*x_diff_log10)+x_log1")
expression_4 = Expression(
    value_y=cull_pattern_4,
    y_diff_log10=subtraction_2,
    y_log1=deconstruct_4.YComponent,
    Expression="(log10(value_y)*y_diff_log10)+y_log1")
construct_point = ConstructPoint(XCoordinate=expression_3, YCoordinate=expression_4, ZCoordinate=point_elevations_z)

# ---- group: Singh
alpha = Number(explode_tree.Branch4)
beta = Number(explode_tree.Branch5)
expression_5 = Expression(alpha=alpha, Expression="If(alpha<0,0,if(alpha>10,10,alpha))")
expression_6 = Expression(
    alpha=expression_5,
    beta=beta,
    A_x=deconstruct.XComponent,
    B_x=deconstruct_2.XComponent,
    C_x=deconstruct_3.XComponent,
    Expression="(1-beta)*((1-log10(alpha))*A_x+log10(alpha)*B_x)+beta*C_x")
expression_7 = Expression(
    alpha=expression_5,
    beta=beta,
    A_y=deconstruct.YComponent,
    B_y=deconstruct_2.YComponent,
    C_y=deconstruct_3.YComponent,
    Expression="(1-beta)*((1-log10(alpha))*A_y+log10(alpha)*B_y)+beta*C_y")
construct_point_2 = ConstructPoint(XCoordinate=expression_6, YCoordinate=expression_7, ZCoordinate=point_elevations_z)

# ----
# Create data tree and plot with different colours
customised_color_list_removed_dfn_gen_e = Panel("""#8b4513
#228b22
#808000
#483d8b
#008080
#4682b4
#000080
#8b008b
#b03060
#66cdaa
#ff0000
#ffa500
#ffff00
#00ff00
#8a2be2
#dc143c
#eee8aa
#adff2f
#ff7f50
#ff00ff
#1e90ff
#0000ff
#add8e6
#ff1493
#ee82ee
#98fb98
#ffc0cb""")
count_unique_2 = CountUnique(Key=explode_tree.Branch0, SortIfPossible=False, LastSaveLocalization="neutral,N")  # -> KeyList, Count
list_indices_3 = ListIndices(List=count_unique_2.KeyList)
duplicate_data_3 = DuplicateData(Data=simplify(graft(customised_color_list_removed_dfn_gen_e)), Number=simplify(graft(count_unique_2.Count)), Order=True)  # -> flatten(Data)
duplicate_data_4 = DuplicateData(Data=simplify(graft(list_indices_3)), Number=simplify(graft(count_unique_2.Count)), Order=True)  # -> flatten(Data)
create_tree_3 = CreateTree(Data=construct_point, Path=duplicate_data_4)
create_tree_4 = CreateTree(Data=duplicate_data_3, Path=duplicate_data_4)
number_slider = Slider(26, range=0..26)
list_item_3 = ListItem(List=panel_2, Index=number_slider, Wrap=invert(True))
concatenate_2 = Concatenate(FragmentA="DFN_Gen", FragmentB=list_item_3)
text_tag = TextTag(Location=Point(60.62135152, -104.1948182, 0), Text=concatenate_2, Colour="Black")
create_tree_5 = CreateTree(Data=construct_point_2, Path=duplicate_data_4)
tree_branch = TreeBranch(Tree=create_tree_3, Path=number_slider, MaintainPaths=True)
tree_branch_2 = TreeBranch(Tree=create_tree_4, Path=number_slider, MaintainPaths=True)
tree_branch_3 = TreeBranch(Tree=create_tree_5, Path=number_slider, MaintainPaths=True)
adjust_alpha = AdjustAlpha(Color=tree_branch_2, Alpha=Slider(0.1, range=0..1))

dot_display = DotDisplay(Point=[tree_branch, tree_branch_3], Colour=colour_picker, Size=Slider(0.7, range=0..1))
replace_text_4 = ReplaceText(Text=panel_4, Find="?", Replace=list_item_3, RecursiveReplace=False)
panel_14 = Panel(replace_text_4)

# ==== cluster Block_shape_Singh_2022
brep = ClusterInput()
# Refernece:
# Singh, J. et al. (2022) ‘Modified block shape characterization method for classification of fractured rock: A python-based GUI tool’, Computers & Geosciences, 164, p. 105125. Available at: https://doi.org/10.1016/j.cageo.2022.105125.
brep_2 = Brep(brep)
# Calculation of alpha
deconstruct_brep = DeconstructBrep(Brep=brep_2)  # -> Faces, Edges, Vertices
interconnectpoints = InterconnectPoints(Pts=deconstruct_brep.Vertices)
# Calculation of beta
vector = Vector(interconnectpoints)
length = Length(Curve=interconnectpoints)

# ----
# Find longest chord
list_indices = ListIndices(List=interconnectpoints)
sort_list = SortList(Keys=length, ValuesValuesA=list_indices)  # -> reverse(Keys), reverse(ValuesValuesA)
first_last = FirstLast(List=sort_list.ValuesValuesA)  # -> FirstValue, LastValue
longest_chord_index = Integer(first_last.FirstValue)
list_item = ListItem(List=interconnectpoints, Index=longest_chord_index, Wrap=True)

chord_length = Number(length)
end_points = EndPoints(Curve=list_item)  # -> Start, End
amplitude = Amplitude(Vector=vector, Amplitude=chord_length)
volume = Volume(Geometry=brep_2)  # -> Volume, Centroid
area = Area(Geometry=deconstruct_brep.Faces)  # -> Area, Centroid
chord_length_2 = Number(length)
mass_addition = MassAddition(Input=area.Area)  # -> Result, PartialResults
statistics = Statistics(Series=chord_length_2)  # -> SampleMean, Median, Average, StandardDeviation, Skewness, Kurtosis, Variance
l_med = Number(statistics.Median)
l_med_2 = Number(l_med)
larger_than = LargerThan(FirstNumber=chord_length, SecondNumber=l_med_2)  # -> LargerThan, OrEqualTo

# ---- group: Remove longest chord from the lsit
replace_items = ReplaceItems(List=larger_than.OrEqualTo, Item="False", Indices=longest_chord_index, Wrap=False)

# ---- group: Chords longer than median
cull_pattern = CullPattern(List=interconnectpoints, CullPattern=larger_than.OrEqualTo)

# ---- group: Group A
curve_closest_point = CurveClosestPoint(Point=end_points.Start, Curve=cull_pattern)  # -> Point, Parameter, Distance
equality_within_tolerance = EqualityWithinTolerance(FirstNumber=curve_closest_point.Distance, SecondNumber="0", Tolerance=0.01)  # -> Equality, Inequality
cull_pattern_2 = CullPattern(List=cull_pattern, CullPattern=equality_within_tolerance.Equality)

# ---- group: Group B
curve_closest_point_2 = CurveClosestPoint(Point=end_points.End, Curve=cull_pattern)  # -> Point, Parameter, Distance
equality_within_tolerance_2 = EqualityWithinTolerance(FirstNumber=curve_closest_point_2.Distance, SecondNumber="0", Tolerance=0.01)  # -> Equality, Inequality
cull_pattern_3 = CullPattern(List=cull_pattern, CullPattern=equality_within_tolerance_2.Equality)

# ----
panel = Panel(mass_addition.Result)
tree_statistics = TreeStatistics(Tree=brep_2)  # -> Paths, Length, Count
expression = Expression(
    A_s=flatten(mass_addition.Result),
    l_avg=flatten(statistics.Average),
    V=flatten(volume.Volume),
    Expression="(A_s*l_avg)/(7.7*V)")

# ---- group: Calculate Group A Beta
group_a_curves = Curve(cull_pattern_2)
cross_reference = CrossReference(ListListA=group_a_curves, ListListB=group_a_curves, CrossMode=2)  # -> ListListA, ListListB
angle = Angle(VectorA=cross_reference.ListListA, VectorB=cross_reference.ListListB)  # -> Angle, Reflex
expression_2 = Expression(angle=angle.Angle, Expression="(cos(angle))²")
min_max = MinMax(Number=expression_2)  # -> Minimum, Maximum
smallest_beta_groupa = Number(min_max.Minimum)

# ----
list_item_2 = ListItem(List=amplitude, Index=longest_chord_index, Wrap=True)

# ---- group: Calculate Group B Beta
group_b_curves = Curve(cull_pattern_3)
cross_reference_2 = CrossReference(ListListA=group_b_curves, ListListB=group_b_curves, CrossMode=2)  # -> ListListA, ListListB
angle_2 = Angle(VectorA=cross_reference_2.ListListA, VectorB=cross_reference_2.ListListB)  # -> Angle, Reflex
expression_3 = Expression(angle=angle_2.Angle, Expression="(cos(angle))²")
min_max_2 = MinMax(Number=expression_3)  # -> Minimum, Maximum
smallest_beta_groupb = Number(min_max_2.Minimum)

# ----
duplicate_data = DuplicateData(Data=simplify(graft(tree_statistics.Paths)), Number=simplify(graft(tree_statistics.Length)), Order=True)  # -> flatten(Data)
longest_chord_vector = Vector(list_item_2)
create_tree = CreateTree(Data=expression, Path=duplicate_data)
alpha = Number(create_tree)
alpha_2 = ClusterOutput(alpha)
expression_4 = Expression(
    Beta_1=flatten(smallest_beta_groupa),
    Beta_2=flatten(smallest_beta_groupb),
    Expression="(2*Beta_1*Beta_2)/(Beta_1+Beta_2)")
create_tree_2 = CreateTree(Data=expression_4, Path=duplicate_data)
beta_final = Number(create_tree_2)
beta_final_2 = ClusterOutput(beta_final)
