# Grasshopper definition E-Calculation_Network_topology.gh (Grasshopper 1.0.8)
# plug-ins: RhinoCodePluginGH, Anemone, Human, LunchBox, MetaHopper, eleFront, Wombat

# ----
# Network topology
# Developed by: Jessica Ka Yi Chiu
# 
# 1. User inputs
# 2. Loop for all processes
# 3. Import data
# 4. Determine I-, X-, Y-nodes
# 5. Export results
# 6. Visualise results
# Colour code:
# User input
# Pre-defined values
# 1. USER INPUTS
# Step 1: DFN_Gen list and input file path
dfn_gen_id_list = Panel("""1
2
3
4
5
6
7
8
9
10
11
A
B
C
D
F
G
H
I
J
K
L
M
N
O
P
Q""")
dxf_file_path_as_identifier = Panel("C:\Users\KYC\Downloads\FracMan_Trace DXF\DFN_gen?_Trace.dxf")
stl_file_path_as_identifier = Panel("C:\Users\KYC\Downloads\PerlinSurface STL\DFN_gen?_PerlinSurface.stl")

# ----
# Step 2: Detemine nodes & export results
# Export coordinates of nodes for each DFN_Gen
# Export PNG of joint trace network for each DFN_Gen.
# If set to True, adjust the Rhino display to the desired dimension
# Display nodes in joint trace network?
# Run analysis
save_csv_overwritable = BooleanToggle(False)
save_png_overwritable = BooleanToggle(False)
display_nodes = BooleanToggle(False)
tolerance_m = Slider(0.1, range=0..0.1)
output_file_path_exclude_file_format = Panel("C:\Users\KYC\Downloads\FracMan_Trace_NetworkConnectivity\DFN_Gen?_nodes")
determine_i_x_y_node = BooleanToggle(False)
display_symbol_size = Slider(3, range=0..10)

# ----
# 2. LOOP FOR ALL PROCESSES
# Loop for all data import, export, calculations and visualisations
# Results
# 3. IMPORT DATA
panel = Panel("?")
run = Boolean(determine_i_x_y_node)
list_length = ListLength(List=dfn_gen_id_list)
loop_start = LoopStart(Repeat=list_length, Trigger=run)  # -> port, Counter, Data
panel_2 = Panel(loop_start.Counter)
list_item = ListItem(List=dfn_gen_id_list, Index=loop_start.Counter, Wrap=True)

# ----
# Import Perlin surface STL
stl_file_path = Text(stl_file_path_as_identifier)
replace_text = ReplaceText(Text=stl_file_path, Find=panel, Replace=list_item, RecursiveReplace=False)

# ----
# Import Joint trace DXF
dxf_file_path = Text(dxf_file_path_as_identifier)
replace_text_2 = ReplaceText(Text=dxf_file_path, Find=panel, Replace=list_item, RecursiveReplace=False)

# ----
# Slope boundary display
import_3dm = Import3DM(File=replace_text, Layer="*", Name="*")
mesh = Mesh(import_3dm)
mesh_edges = MeshEdges(Mesh=mesh)  # -> NakedEdges, InteriorEdges, NonManifoldEdges
join_curves = JoinCurves(Curves=mesh_edges.NakedEdges, Preserve=False)
domain_boundary_curve = Geometry(join_curves)
colour_picker = ColourPicker(PickedColour=RGBA(128, 128, 128, 122))
custom_preview_lineweights = CustomPreviewLineweights(Geometry=domain_boundary_curve, Shader=colour_picker, Thickness=Slider(0.15, range=0..1), Absolute=invert(False))

# ----
# 6. VISUALISE RESULTS
# Joint trace display
import_3dm_2 = Import3DM(File=replace_text_2, Layer="*", Name="*")
custom_preview_lineweights_2 = CustomPreviewLineweights(Geometry=import_3dm_2, Shader="Black", Absolute=False)

# ----
# 4. DETERMINE I-, X-, Y-NODES
# Tree or list input for "domain boundary" and curve"
tolerance_m_2 = Number(tolerance_m)
stream_filter = StreamFilter(Gate=run, Stream1=import_3dm_2)
network_topology = Network_topology(curve=stream_filter, tolerance_m=tolerance_m_2, domain_boundary_curve=domain_boundary_curve)  # -> i_nodes_2, y_nodes_2, x_nodes_2, num_ixy_2
panel_3 = Panel(network_topology.num_ixy_2)
y_nodes = EleFrontDataDescription(network_topology.y_nodes_2, ShiftDepth=0, isNameSet=True)
i_nodes = EleFrontDataDescription(network_topology.i_nodes_2, ShiftDepth=0, isNameSet=True)
x_nodes = EleFrontDataDescription(network_topology.x_nodes_2, ShiftDepth=0, isNameSet=True)
entwine = Entwine(Branch00=i_nodes, Branch01=x_nodes, Branch02=y_nodes, FlattenInputs=True)  # -> simplify(Result)
list_length_2 = ListLength(List=entwine)
list_length_3 = ListLength(List=x_nodes)
list_length_4 = ListLength(List=y_nodes)

loop_end = LoopEnd(
    port=loop_start.port,
    Exit=False,
    Data=network_topology.num_ixy_2,
    TimeOutVal=0,
    pausedState=False,
    state="Constant & Record")

sum_of_nodes_i_x_y_for_each_dfn_gen = Panel(loop_end)

# ----
# 5. EXPORT RESULTS
output_file_path = Text(output_file_path_exclude_file_format)
panel_4 = Panel("""Node_type
X
Y
Z""")
panel_5 = Panel("""I
X
Y""")
deconstruct = Deconstruct(Point=entwine)  # -> flatten(XComponent), flatten(YComponent), flatten(ZComponent)
duplicate_data = DuplicateData(Data=simplify(graft(panel_5)), Number=list_length_2, Order=True)  # -> flatten(Data)
entwine_2 = Entwine(
    Branch00=duplicate_data,
    Branch01=deconstruct.XComponent,
    Branch02=deconstruct.ZComponent,
    Branch03=deconstruct.ZComponent,
    FlattenInputs=True)  # -> simplify(Result)
create_csv = CreateCSV(DataGridHeaders=panel_4, ValueTree=entwine_2, Delimiter=",")
replace_text_3 = ReplaceText(Text=output_file_path, Find=panel, Replace=list_item, RecursiveReplace=False)
concatenate = Concatenate(FragmentA=replace_text_3, FragmentB=".csv")
concatenate_2 = Concatenate(FragmentA=replace_text_3, FragmentB=".png")

save_csv_overwritable_2 = Boolean(save_csv_overwritable)
multiplication = Multiplication(A=run, B=save_csv_overwritable_2)
write_to_text_file = WriteToTextFile(Run=False, TextToWrite=create_csv, FilePath=concatenate, Append=False, NewOnly=False)

save_png_overwritable_2 = Boolean(save_png_overwritable)
multiplication_2 = Multiplication(A=run, B=save_png_overwritable_2)
ironpython_2_script = IronPython2Script(viewport_name=multiplication_2, file_path=concatenate_2)  # -> out, a; inputs viewport_name: String, file_path: String, run: Boolean
# ---------- ironpython_2_script: IronPython ----------
import rhinoscriptsyntax as rs

def capture_viewport(file_path, run, viewport_name):
    if run:
        # Ensure the file path is properly formatted
        formatted_path = '"' + file_path + '"'
        # Activate the specified viewport
        rs.CurrentView(viewport_name)
        # Construct the command string
        command = '-_ViewCaptureToFile {} _Enter'.format(formatted_path)
        # Run the command
        rs.Command(command, True)

# Inputs from Grasshopper
capture_viewport(file_path, run, viewport_name)
# ---------- end ironpython_2_script ----------

# ----
# Node Display
display_node_size = Number(display_symbol_size)
y_nodes_2 = EleFrontDataDescription(y_nodes, ShiftDepth=0, isNameSet=True)
i_nodes_2 = EleFrontDataDescription(i_nodes, ShiftDepth=0, isNameSet=True)
x_nodes_2 = EleFrontDataDescription(x_nodes, ShiftDepth=0, isNameSet=True)
expression = Expression(x=display_node_size, Expression="x*2")
symbol_simple = SymbolSimple(Style=5, Size=display_node_size, Rotation=0, Colour="Green")
symbol_simple_2 = SymbolSimple(Style=7, Size=expression, Rotation=0, Colour="Red")
symbol_simple_3 = SymbolSimple(Style=1, Size=display_node_size, Rotation=0, Colour="Blue")
symbol_display = SymbolDisplay(Location=i_nodes_2, Display=symbol_simple)
symbol_display_2 = SymbolDisplay(Location=x_nodes_2, Display=symbol_simple_3)
hide_show_object_preview = HideShowObjectPreview(Visible=display_nodes, AllObjects_Object=[symbol_display, symbol_display_2, symbol_display_3])
symbol_display_3 = SymbolDisplay(Location=y_nodes_2, Display=symbol_simple_2)

# ==== cluster Network_topology
domain_boundary_curve = ClusterInput()
# Reference: Manzocchi, T., 2002. The connectivity of two dimensional networks of spatially correlated fractures. Water Resour. Res. 38 http://dx.doi.org/10.1029/ 2000WR000180.
curve = ClusterInput()
tolerance_m = ClusterInput()
domain_boundary_curve_2 = Curve(domain_boundary_curve)
curve_2 = Curve(curve)
curve_middle = CurveMiddle(Curve=curve_2)
point_list = PointList(Points=curve_middle, Size="0.5")
tolerance_m_2 = Number(tolerance_m)
list_indices = ListIndices(List=curve_2)

# ----
# X-node = where two unbroken joints cross without termination.
# If X-node is close to the end of the curve, delete the X-node.
reparameterize_curve = ReparameterizeCurve(Curve=curve_2)  # -> Reparameterized, Original
multiple_curves = MultipleCurves(Curves=reparameterize_curve.Reparameterized)  # -> Points, IndexA, IndexB, ParamA, ParamB
length = Length(Curve=curve_2)

# ---- group: A lengths
list_item = ListItem(List=length, Index=multiple_curves.IndexA, Wrap=True)
multiplication = Multiplication(A=multiple_curves.ParamA, B=list_item)
subtraction = Subtraction(A=list_item, B=multiplication)

# ---- group: B lengths
list_item_2 = ListItem(List=length, Index=multiple_curves.IndexB, Wrap=True)
multiplication_2 = Multiplication(A=multiple_curves.ParamB, B=list_item_2)
subtraction_2 = Subtraction(A=list_item_2, B=multiplication_2)

# ----
larger_than = LargerThan(FirstNumber=subtraction, SecondNumber=tolerance_m_2)  # -> LargerThan, OrEqualTo
larger_than_2 = LargerThan(FirstNumber=multiplication_2, SecondNumber=tolerance_m_2)  # -> LargerThan, OrEqualTo
larger_than_3 = LargerThan(FirstNumber=subtraction_2, SecondNumber=tolerance_m_2)  # -> LargerThan, OrEqualTo
larger_than_4 = LargerThan(FirstNumber=multiplication, SecondNumber=tolerance_m_2)  # -> LargerThan, OrEqualTo
multiplication_3 = Multiplication(A=larger_than_4.LargerThan, B=larger_than.LargerThan, C=larger_than_2.LargerThan, D=larger_than_3.LargerThan)
cull_pattern = CullPattern(List=multiple_curves.Points, CullPattern=multiplication_3)
cull_duplicates = CullDuplicates(Points=cull_pattern, Tolerance=tolerance_m_2, CullMode=1)  # -> Points, Indices, Valence
x_nodes = Point(simplify(flatten(cull_duplicates.Points)))
x_nodes_2 = ClusterOutput(x_nodes)

list_length = ListLength(List=x_nodes)

# ----
# I-node = end points of curves within the domain boundary.
# If an I-node is close to another line within threshold, it is a Y-node.
end_points = EndPoints(Curve=curve_2)  # -> Start, End
cross_reference = CrossReference(ListListA=list_indices, ListListB=list_indices, CrossMode=2)  # -> ListListA, ListListB

# ---- group: Start points
list_item_3 = ListItem(List=end_points.Start, Index=cross_reference.ListListB, Wrap=True)

# ---- group: End points
list_item_4 = ListItem(List=end_points.End, Index=cross_reference.ListListB, Wrap=True)

# ---- group: Other curves
list_item_5 = ListItem(List=curve_2, Index=cross_reference.ListListA, Wrap=True)

# ---- group: Cull start points at Y-node
curve_closest_point = CurveClosestPoint(Point=list_item_3, Curve=list_item_5)  # -> Point, Parameter, Distance
larger_than_5 = LargerThan(FirstNumber=curve_closest_point.Distance, SecondNumber=tolerance_m_2)  # -> LargerThan, OrEqualTo
create_tree = CreateTree(Data=larger_than_5.LargerThan, Path=cross_reference.ListListB)
mass_multiplication = MassMultiplication(Input=create_tree)  # -> flatten(Result), PartialResults
cull_pattern_2 = CullPattern(List=end_points.Start, CullPattern=mass_multiplication.Result)
renumber_paths = RenumberPaths(Data=cull_pattern_2)

# ---- group: Cull end points at Y-node
curve_closest_point_2 = CurveClosestPoint(Point=list_item_4, Curve=list_item_5)  # -> Point, Parameter, Distance
larger_than_6 = LargerThan(FirstNumber=curve_closest_point_2.Distance, SecondNumber=tolerance_m_2)  # -> LargerThan, OrEqualTo
create_tree_2 = CreateTree(Data=larger_than_6.LargerThan, Path=cross_reference.ListListB)
mass_multiplication_2 = MassMultiplication(Input=create_tree_2)  # -> flatten(Result), PartialResults
cull_pattern_3 = CullPattern(List=end_points.End, CullPattern=mass_multiplication_2.Result)
renumber_paths_2 = RenumberPaths(Data=cull_pattern_3)

# ---- group: Convert start points to Y-node
cull_pattern_4 = CullPattern(List=end_points.Start, CullPattern=invert(mass_multiplication.Result))
renumber_paths_3 = RenumberPaths(Data=cull_pattern_4)

# ---- group: Convert end points to Y-node
cull_pattern_5 = CullPattern(List=end_points.End, CullPattern=invert(mass_multiplication_2.Result))
renumber_paths_4 = RenumberPaths(Data=cull_pattern_5)

# ----
merge = Merge(Data1=renumber_paths, Data2=renumber_paths_2)  # -> simplify(Result)
merge_2 = Merge(Data1=renumber_paths_3, Data2=renumber_paths_4)  # -> simplify(Result)
curve_closest_point_3 = CurveClosestPoint(Point=flatten(merge), Curve=domain_boundary_curve_2)  # -> Point, Parameter, Distance
y_nodes = Point(simplify(flatten(merge_2)))
larger_than_7 = LargerThan(FirstNumber=curve_closest_point_3.Distance, SecondNumber=tolerance_m_2)  # -> LargerThan, OrEqualTo
y_nodes_2 = ClusterOutput(y_nodes)
cull_pattern_6 = CullPattern(List=merge, CullPattern=larger_than_7.LargerThan)
i_nodes = Point(simplify(flatten(cull_pattern_6)))
i_nodes_2 = ClusterOutput(i_nodes)

list_length_2 = ListLength(List=y_nodes)
list_length_3 = ListLength(List=i_nodes)
concatenate = Concatenate(Fragment_A=list_length_3, C=",", B=list_length, A=",", Fragment_B=list_length_2)
num_ixy = Text(concatenate)
num_ixy_2 = ClusterOutput(num_ixy)
