# Grasshopper definition Modelling_synthetic_DFN_dataset_many_textures.gh (Grasshopper 1.0.8)
# Copyright: 2022
# plug-ins: RhinoCodePluginGH, Heteroptera, Pufferfish, Anemone, Human, MetaHopper, Pancake, Wombat

# ----
# Synthetic DFN dataset with many textures
# Developed by: Jessica Ka Yi Chiu
# 1. User inputs
# 2. Joint trace modelling
# 3. Camera positioning
# 4. Multiple textures mapping (by duplicating geometries with large horizontal spacing)
# 5, Custom preview setting
# 6. Photo-shooting & image export loop
# Colour code:
# User input
# 1. USER INPUTS
# Step 1: CHECK RHINO DOCUMENT DISTANCE TOLERANCE
# Make sure distance tolerance = 0.001
# If not, in Rhino Interface, go to File > Properties > Unit > Set Absolute Tolerance = 0.001 m
document_distance_tolerance = DocumentDistanceTolerance()
# Results
# Pre-defined values
panel = Panel(document_distance_tolerance)

# ----
# Step 2: FILE INPUTS
file_path_for_perlinsurface_stl_put_as_i = Panel("C:\Users\KYC\Downloads\PerlinSurface STL\DFN_gen?_PerlinSurface.stl")  # "File path for PerlinSurface (STL), put ? as identifier"
file_path_for_joint_trace_dxf_put_as_ide = Panel("C:\Users\KYC\Downloads\FracMan_Trace DXF\DFN_gen?_Trace.dxf")  # "File path for Joint Trace (DXF), put ? as identifier"
list_of_texture_file_path = Panel("""C:\Users\KYC\OneDrive - NGI\Documents\PhD\Paper - Synthetic rock joint generation for ML\Textures\dry_riverbed_rock_4k.blend\textures\dry_riverbed_rock_diff_4k.jpg
C:\Users\KYC\OneDrive - NGI\Documents\PhD\Paper - Synthetic rock joint generation for ML\Textures\lichen_rock_4k.blend\textures\lichen_rock_diff_4k.jpg
C:\Users\KYC\OneDrive - NGI\Documents\PhD\Paper - Synthetic rock joint generation for ML\Textures\mossy_rock_4k.blend\textures\mossy_rock_diff_4k.jpg
C:\Users\KYC\OneDrive - NGI\Documents\PhD\Paper - Synthetic rock joint generation for ML\Textures\rock_boulder_dry_4k.blend\textures\rock_boulder_dry_diff_4k.jpg
C:\Users\KYC\OneDrive - NGI\Documents\PhD\Paper - Synthetic rock joint generation for ML\Textures\rock_face_03_4k.blend\textures\rock_face_03_diff_4k.jpg
C:\Users\KYC\OneDrive - NGI\Documents\PhD\Paper - Synthetic rock joint generation for ML\Textures\sandstone_blocks_04_4k.blend\textures\sandstone_blocks_04_diff_4k.jpg
C:\Users\KYC\OneDrive - NGI\Documents\PhD\Paper - Synthetic rock joint generation for ML\Textures\worn_rock_natural_01_4k.blend\textures\worn_rock_natural_01_diff_4k.jpg
C:\Users\KYC\OneDrive - NGI\Documents\PhD\Paper - Synthetic rock joint generation for ML\Textures\cliff_side_4k.blend\textures\cliff_side_diff_4k.jpg""")

# ----
# Step 3: CHOOSE A DFN MODEL
list_of_dfn_model_identifiers = Panel("""1
2
3
4
5
6
7
8
9
10
11
A
B
C
D
F
G
H
I
J
K
L
M
N
O
P
Q""")
choose_one_dfn_model_identifier = ValueList({"1": 0, "2": 1, "3": 2, "4": 3, "5": 4, "6": 5, "7": 6, "8": 7, "9": 8, "10": 9, "11": 10, "A": 11, "B": 12, "C": 13, "D": 14, "F": 15, "G": 16, "H": 17, "I": 18, "J": 19, "K": 20, "L": 21, "M": 22, "N": 23, "O": 24, "P": 25, "Q": 26}, selected="1")

# ----
# Step 4: TEXTURE MAPPING
selected_texture_id_list_of_texture_file = Panel("""3
4
5
6
7""")  # "Selected texture ID (List of Texture file path)"
horizontal_spacing_m = Panel("1000")
box_mapping_scale = Slider(30, range=0..100)

# ----
# Step 5: JOINT TRACE SETTINGS
virtual_thickness_scaling_factor_shadow = Panel("1.5")
virtual_thickness_scaling_factor_narrow = Panel("0.5")  # "Virtual thickness scaling factor (Narrow opening)"
minimum_virtual_joint_thickness_in_label = Panel("0.01")  # "Minimum virtual joint thickness in label images (m)"
curvy_thin_trace_resolution_m = Panel("0.1")

# ---- group: 0 = round; 1 = miter; 2 = bever
curve_visualisation_join_style = Panel("2")

# ---- group: 0 = round; 1 = flat; 2 = square
curve_visualisation_cap_style = Panel("0")

# ----
# Get DFN identifier
dfn_model_identifier_list = Text(list_of_dfn_model_identifiers)
dfn_model_identifier_index = Integer(choose_one_dfn_model_identifier)
list_item = ListItem(List=dfn_model_identifier_list, Index=dfn_model_identifier_index, Wrap=True)

# ----
# Get joint trace curve geometry & lengths
joint_trace_dxf_file_path = FilePath(file_path_for_joint_trace_dxf_put_as_ide)
replace_text = ReplaceText(Text=joint_trace_dxf_file_path, Find="?", Replace=list_item, RecursiveReplace=False)
joint_trace_dxf_file_path_2 = FilePath(replace_text)
panel_2 = Panel(joint_trace_dxf_file_path_2)
import_from = ImportFrom(File=joint_trace_dxf_file_path_2, LastSaveLocalization="neutral,N")  # -> Geo, Layer, ObjectAttributes
joint_trace_curve = Curve(import_from.Geo)
length = Length(Curve=joint_trace_curve)
joint_trace_length_m = Number(length)

# ----
# VIRTUAL JOINT THICKNESS EQUATION
minimum_virtual_joint_thickness_m = Panel("0.001")
max_joint_trace_length_m = Panel("100")
maximum_virtual_joint_thickness_m = Panel("0.1")
max_length = Number(max_joint_trace_length_m)
max_thickness = Number(maximum_virtual_joint_thickness_m)
min_thickness = Number(minimum_virtual_joint_thickness_m)
joint_trace_length_m_2 = Number(joint_trace_length_m)
expression = Expression(
    max_length=max_length,
    max_thickness=max_thickness,
    min_thickness=min_thickness,
    L=joint_trace_length_m_2,
    Expression="L/(max_length)*(max_thickness-min_thickness)+min_thickness")
virtual_thickness = Number(expression)

# ----
# 2. JOINT TRACE MODELLING
virtual_thickness_2 = Number(virtual_thickness)

# ----
# RockMass-thick joint traces refinement
virtual_thickness_scaling_factor_shadow_2 = Number(virtual_thickness_scaling_factor_shadow)
multiplication = Multiplication(A=virtual_thickness_2, B=virtual_thickness_scaling_factor_shadow_2)  # -> simplify(graft(Result))
rockmass_thick_trace = Geometry(flatten(joint_trace_curve))
rockmass_thick_trace_plotting_thickness = Number(multiplication)  # "RockMass-thick trace plotting thickness (m)"

# ----
# Label-joint traces refinement
minimum_virtual_joint_thickness_in_label_2 = Number(minimum_virtual_joint_thickness_in_label)  # "Minimum virtual joint thickness in label images (m)"
smaller_than = SmallerThan(FirstNumber=virtual_thickness_2, SecondNumber=minimum_virtual_joint_thickness_in_label_2)  # -> SmallerThan, OrEqualTo
cull_pattern = CullPattern(List=virtual_thickness_2, CullPattern=invert(smaller_than.OrEqualTo))
cull_pattern_2 = CullPattern(List=joint_trace_curve, CullPattern=invert(smaller_than.OrEqualTo))
label_trace_plotting_thickness_m = Number(flatten(cull_pattern))
label_trace_curves = Geometry(flatten(cull_pattern_2))

# ----
# Get PerlinSurface geometry
perlinsurface_stl_file_path = FilePath(file_path_for_perlinsurface_stl_put_as_i)
replace_text_2 = ReplaceText(Text=perlinsurface_stl_file_path, Find="?", Replace=list_item, RecursiveReplace=False)
import_from_2 = ImportFrom(File=replace_text_2, LastSaveLocalization="neutral,N")  # -> Geo, Layer, ObjectAttributes
perlinsurface_mesh = Mesh(import_from_2.Geo)

# ---- group: Curvey point within virtual joint thickness radius
division = Division(A=virtual_thickness_2, B="2")
construct_domain = ConstructDomain(DomainStart=0, DomainEnd=division)

# ----
# RockMass-curvy thin traces refinement
curvy_thin_trace_resolution_m_2 = Number(curvy_thin_trace_resolution_m)
length_2 = Length(Curve=joint_trace_curve)
division_2 = Division(A=length_2, B=curvy_thin_trace_resolution_m_2)
round = Round(Number=division_2)  # -> Nearest, Floor, Ceiling
curvy_point_emiter = CurvyPointEmiter(Curve=joint_trace_curve, Radius=construct_domain, Number=round.Ceiling, onframe=True, perp=True)  # -> simplify(Points)
sort_along_curve = SortAlongCurve(Points=curvy_point_emiter, Curve=simplify(graft(joint_trace_curve)))  # -> Points, Indices
virtual_thickness_scaling_factor_narrow_2 = Number(virtual_thickness_scaling_factor_narrow)  # "Virtual thickness scaling factor (Narrow opening)"
multiplication_2 = Multiplication(A=virtual_thickness_2, B=virtual_thickness_scaling_factor_narrow_2)  # -> simplify(graft(Result))
polyline = PolyLine(Vertices=sort_along_curve.Points, Closed=False)  # -> simplify(Polyline)
rockmass_thin_trace_plotting_thickness_m = Number(multiplication_2)
rockmass_thin_trace = Geometry(flatten(polyline))

# ----
# 4. MULTIPLE TEXTURES MAPPING
# Duplicating geometries with fixed horizontal spacing and file names
selected_texture_id = Integer(selected_texture_id_list_of_texture_file)
horizontal_spacing_m_2 = Number(horizontal_spacing_m)
list_of_texture_file_path_2 = FilePath(list_of_texture_file_path)
last_index = LastIndex(List=selected_texture_id)
list_length = ListLength(List=selected_texture_id)
list_item_2 = ListItem(List=list_of_texture_file_path_2, Index=selected_texture_id, Wrap=True)

# ----
# Box mapping
box_mapping_scale_2 = Number(box_mapping_scale)
perlinsurface_mesh_2 = Mesh(perlinsurface_mesh)
domain_box = DomainBox(Base=PlaneXY(0, 0, 0), X=box_mapping_scale_2, Y=box_mapping_scale_2, Z=box_mapping_scale_2)
boxmapping = BoxMapping(Mesh=perlinsurface_mesh_2, Box=domain_box)
box_mapped_perlinsurface_mesh = Geometry(boxmapping)

# ---- group: Set PerlinSurface as white
box_mapped_perlinsurface_mesh_2 = Geometry(box_mapped_perlinsurface_mesh)
create_material = CreateMaterial(Diffuse="White", Specular="White", Emission="White", Transparency="0", Shine="0")
custom_preview = CustomPreview(Geometry=box_mapped_perlinsurface_mesh_2, Material=create_material)

# ----
# Move geometries
range = Range(Domain=last_index, Steps=last_index)
multiplication_3 = Multiplication(A=range, B=horizontal_spacing_m_2)
box_mapped_perlinsurface_mesh_3 = Geometry(box_mapped_perlinsurface_mesh)
rockmass_thick_trace_2 = Geometry(flatten(rockmass_thick_trace))
unit_y = UnitY(Factor=multiplication_3)
rockmass_thin_trace_2 = Geometry(flatten(rockmass_thin_trace))
label_trace = Geometry(flatten(label_trace_curves))
move = Move(Geometry=rockmass_thick_trace_2, Motion=simplify(graft(unit_y)))  # -> simplify(Geometry), Transform
move_2 = Move(Geometry=rockmass_thin_trace_2, Motion=simplify(graft(unit_y)))  # -> simplify(Geometry), Transform
move_3 = Move(Geometry=box_mapped_perlinsurface_mesh_3, Motion=unit_y)  # -> Geometry, Transform
move_4 = Move(Geometry=label_trace, Motion=simplify(graft(unit_y)))  # -> simplify(Geometry), Transform
flip_matrix = FlipMatrix(Data=move.Geometry)
flip_matrix_2 = FlipMatrix(Data=move_2.Geometry)
flip_matrix_3 = FlipMatrix(Data=move_4.Geometry)

# ----
# 5. CUSTOM PREVIEW SETTINGS
just_a_random_input_so_that_the_componen = Panel("Joint trace")  # "Just a random input so that the component will run"
cap_style = Integer(curve_visualisation_cap_style)
join_style = Integer(curve_visualisation_join_style)

# ----
# Joint trace images
colour_picker = ColourPicker(PickedColour=RGB(0, 0, 0))
colour_picker_2 = ColourPicker(PickedColour=RGBA(0, 0, 0, 100))
model_linetype = ModelLinetype(
    Name=just_a_random_input_so_that_the_componen,
    CapStyle=cap_style,
    JoinStyle=join_style,
    Width=rockmass_thick_trace_plotting_thickness,
    WidthUnits=1)  # -> ModelLinetype, Name, Segments, CapStyle, JoinStyle, Width, WidthUnits
model_linetype_2 = ModelLinetype(
    Name=just_a_random_input_so_that_the_componen,
    CapStyle=cap_style,
    JoinStyle=join_style,
    Width=rockmass_thin_trace_plotting_thickness_m,
    WidthUnits=1)  # -> ModelLinetype, Name, Segments, CapStyle, JoinStyle, Width, WidthUnits
custom_curve_preview = CustomCurvePreview(Curve=flip_matrix_2, Linetype=model_linetype_2.ModelLinetype, Colour=colour_picker)
custom_curve_preview_2 = CustomCurvePreview(Curve=flip_matrix, Linetype=model_linetype.ModelLinetype, Colour=colour_picker_2)

# ----
# Slope texture
custom_preview_materials = CustomPreviewMaterials(Geometry=move_3.Geometry, DiffuseColor=RGB(255, 255, 255), DiffuseBitmap=list_item_2)

# ----
# Joint trace labels
colour_picker_3 = ColourPicker(PickedColour=RGB(0, 0, 0))
model_linetype_3 = ModelLinetype(
    Name=just_a_random_input_so_that_the_componen,
    CapStyle=cap_style,
    JoinStyle=join_style,
    Width=label_trace_plotting_thickness_m,
    WidthUnits=1)  # -> ModelLinetype, Name, Segments, CapStyle, JoinStyle, Width, WidthUnits
custom_curve_preview_3 = CustomCurvePreview(Curve=flip_matrix_3, Linetype=simplify(graft(model_linetype_3.ModelLinetype)), Colour=colour_picker_3)

# ----
# Step 6: RENDERING
# Set solid white background:
# In the specific viewport, go to Display Options > in the specific Display Mode > Set ground plane setting off
number_of_camera_points = Slider(120, range=0..10000)
distance_range_from_camera_and_rock_face = Panel("5 to 10")  # "Distance range from camera and rock face (m)"
rhino_display_mode = Panel("Technical")
camera_distance_scale_factor = Slider(3, range=0..10)
perspective_camera_projection = BooleanToggle(True)
camera_lens_length = Panel("50")
image_export_file_directory = Panel("C:\Users\KYC\Downloads\FracMan-Dataset")
subfolder_directory_names = Panel("""\rockmass\
\label\
""")
file_format = Panel(".png")
rhino_viewport_name = Panel("Perspective")

# ----
# 3. CAMERA POSITIONING
# Populate slope face mesh and generate camera locations
number_of_camera_points_2 = Integer(number_of_camera_points)
camera_distance_range_m = Domain(distance_range_from_camera_and_rock_face)
perlinsurface_mesh_3 = Mesh(perlinsurface_mesh)
camera_point_distribution_seed_number = Panel("42")
camera_distance_scale_factor_2 = Number(camera_distance_scale_factor)
random = Random(Range=camera_distance_range_m, Number=number_of_camera_points_2, Seed=camera_point_distribution_seed_number)
populate_geometry = PopulateGeometry(Geometry=perlinsurface_mesh_3, Count=number_of_camera_points_2, Seed=camera_point_distribution_seed_number)
mesh_closest_point = MeshClosestPoint(Point=populate_geometry, Mesh=perlinsurface_mesh_3)  # -> Point, Index, Parameter
multiplication_4 = Multiplication(A=random, B=camera_distance_scale_factor_2)
mesh_eval = MeshEval(Mesh=perlinsurface_mesh_3, Parameter=mesh_closest_point.Parameter)  # -> Point, Normal, Colour
amplitude = Amplitude(Vector=mesh_eval.Normal, Amplitude=multiplication_4)
move_5 = Move(Geometry=mesh_eval.Point, Motion=amplitude)  # -> Geometry, Transform
camera_targets = Point(mesh_eval.Point)
camera_locations = Point(move_5.Geometry)

# ----
# 6. PHOTO-SHOOTING & IMAGE EXPORT LOOP
rhino_viewport_name_2 = Text(rhino_viewport_name)

# ---- group: Move camera points to other textures
move_6 = Move(Geometry=camera_targets, Motion=simplify(graft(unit_y)))  # -> flatten(Geometry), Transform
move_7 = Move(Geometry=camera_locations, Motion=simplify(graft(unit_y)))  # -> flatten(Geometry), Transform

# ----
# Step 7: IMAGE EXPORT
# Set the desired width and height of Viewport in Rhino before looping and exporting the images
object_visualisation = ValueList({"Rock Mass": 0, "Rock joint annotations": 1}, selected="Rock Mass")
loop_image = BooleanToggle(False)
dataset_file_name_prefix = Panel("FracMan-")
export_image_nb_set_loop_image_to_true = BooleanToggle(False)

# ----
# Loop & progress
loop_image_boolean = Boolean(loop_image)

# ---- group: Loop
list_length_2 = ListLength(List=move_7.Geometry)
invert_boolean = InvertBoolean(Boolean=loop_image_boolean)  # -> Inverted, Number
loop_start = LoopStart(Repeat=list_length_2, Trigger=loop_image_boolean, Data="-1")  # -> port, Counter, Data
addition = Addition(A=loop_start.Data, B="1")
running = Running(
    port=loop_start.port,
    Exit=invert_boolean.Inverted,
    Data=addition,
    TimeOutVal=0,
    pausedState=False,
    state="Constant output")
panel_3 = Panel(running)

# ----
check_total_number_of_image_output = Panel(list_length_2)

# ---- group: Set Viewport
list_item_3 = ListItem(List=move_6.Geometry, Index=loop_start.Data, Wrap=invert(True))
list_item_4 = ListItem(List=move_7.Geometry, Index=loop_start.Data, Wrap=invert(True))
modify_viewport = ModifyViewport(
    ViewportName=rhino_viewport_name_2,
    DisplayMode=rhino_display_mode,
    CameraLocation=list_item_4,
    CameraTarget=list_item_3,
    CameraProjection=perspective_camera_projection,
    CameraLensLength=camera_lens_length,
    AnimateRestore=False,
    RestoreFrames=10)

# ----
# Viewport settings
object_visualisation_0_rockmass_1_label = Panel(object_visualisation)

# ---- group: Progress print
multiplication_5 = Multiplication(A=loop_image_boolean, B=running)
concatenate = Concatenate(Fragment_A="Progress: ", B=multiplication_5, A=" of ", Fragment_B=list_length_2)

# ---- group: Duplicate image suffix (integers)
list_indices = ListIndices(List=camera_targets)
duplicate_data = DuplicateData(Data=list_indices, Number=list_length, Order=True)  # -> flatten(Data)
list_item_5 = ListItem(List=duplicate_data, Index=loop_start.Data, Wrap=invert(True))

# ---- group: Duplicate texture file path
list_length_3 = ListLength(List=camera_targets)
duplicate_data_2 = DuplicateData(Data=list_item_2, Number=list_length_3, Order=invert(True))  # -> flatten(Data)
list_item_6 = ListItem(List=duplicate_data_2, Index=loop_start.Data, Wrap=invert(True))

# ---- group: Get texture name
file_name_from_file_path = FileNameFromFilePath(FilePath=list_item_6)  # -> Name, NameWithExtension
replace_text_3 = ReplaceText(Text=file_name_from_file_path.Name, Find="_diff_4k", Replace="-", RecursiveReplace=False)
texture_text = Text(replace_text_3)

# ---- group: Output file name
# Export Viewport settings
panel_4 = Panel("DFN_gen")
export_image_boolean = Boolean(export_image_nb_set_loop_image_to_true)
concatenate_2 = Concatenate(Fragment_A=panel_4, Fragment_B=list_item, A="-")
dataset_file_name_prefix_2 = Panel(dataset_file_name_prefix)
dfn_model_text = Text(concatenate_2)
texture_text_2 = Text(texture_text)
list_item_7 = ListItem(SubfolderDirectoryNames=subfolder_directory_names, Index=object_visualisation_0_rockmass_1_label, Wrap=True)
concatenate_3 = Concatenate(
    Image_export_file_directory=image_export_file_directory,
    B=list_item_7,
    D=dataset_file_name_prefix_2,
    C=texture_text_2,
    E=dfn_model_text,
    suffix=list_item_5,
    file_format=file_format)
output_file_path = FilePath(concatenate_3)

# ----
output_file_name = Panel(output_file_path)
# NB! Re-writable!
image_export_progress = Panel(concatenate)

# ---- group: Rock Mass image Preview
hide_show_object_preview = HideShowObjectPreview(
    Visible=invert(object_visualisation_0_rockmass_1_label),
    AllObjects_Object=[custom_curve_preview_2, custom_curve_preview, custom_preview_materials])

# ---- group: Label image Preview
hide_show_object_preview_2 = HideShowObjectPreview(Visible=object_visualisation_0_rockmass_1_label, AllObjects_Object=[custom_preview, custom_curve_preview_3])

# ---- group: Output file name / Run Rhino command to export viewport
ironpython_2_script = IronPython2Script(viewport_name=rhino_viewport_name_2, file_path=output_file_path, run=export_image_boolean)  # -> out, a; inputs viewport_name: String, file_path: String, run: Boolean
# ---------- ironpython_2_script: IronPython ----------
import rhinoscriptsyntax as rs

def capture_viewport(file_path, run, viewport_name):
    if run:
        # Ensure the file path is properly formatted
        formatted_path = '"' + file_path + '"'
        # Activate the specified viewport
        rs.CurrentView(viewport_name)
        # Construct the command string
        command = '-_ViewCaptureToFile {} _Enter'.format(formatted_path)
        # Run the command
        rs.Command(command, True)

# Inputs from Grasshopper
capture_viewport(file_path, run, viewport_name)
# ---------- end ironpython_2_script ----------
