# Grasshopper definition Modelling_synthetic_slope_dataset.gh (Grasshopper 1.0.8)
# Copyright: 2022
# plug-ins: RhinoCodePluginGH, Volvox, Pufferfish, Anemone, Human, MetaHopper, Pancake

# ----
# Synthetic slope dataset
# Developed by: Jessica Ka Yi Chiu
# 1. User inputs
# 2. Box modelling
# 3. Joint modelling
# 4. Rock brep modelling
# 5. Camera positioning
# 6, Custom preview setting
# 7. Photo-shooting & image export loop
# Colour code:
# User input
# 1. USER INPUTS
# Step 1: CHECK RHINO DOCUMENT DISTANCE TOLERANCE
# Make sure distance tolerance = 0.001
# If not, in Rhino Interface, go to File > Properties > Unit > Set Absolute Tolerance = 0.001 m
document_distance_tolerance = DocumentDistanceTolerance()
# Results
# Pre-defined values
panel = Panel(document_distance_tolerance)

# ----
# Step 3: ASSIGN WAVY JOINT MODELLING SETTINGS
# Simulate wavy rock joint with aperture
max_waviness_amplitude_m = Panel("0.015")
min_aperture_m = Panel("0.01")
max_aperture_m = Panel("0.1")
uv_spacing_m = Panel("0.5")

# ----
# Step 2: FILE INPUT
# Import a high resolution point cloud to Rhino,
# then set one cloud:
joint_plane_obj_file_path = Panel("C:\Users\KYC\OneDrive - NGI\Documents\PhD\Data\Data processing\Rv4\P1700-1900\JointOBJ\P1700-1900_all_joints.obj")
cloud = Cloud(<cloud referenced from the Rhino model>)
slope_face_mesh_obj_file_path = Panel("C:\Users\KYC\OneDrive - NGI\Documents\PhD\Data\Data processing\Rv4\P1700-1900\P1700-1900_1m_DelaunyMesh.obj")

# ---- group: Rock domain & slope face mesh / added aperture (m) for each dimension
panel_2 = Panel("1.19")
panel_3 = Panel("1.21")
panel_4 = Panel("0.79")

# ---- group: Rock domain & slope face mesh
center = Panel("{0,0,2}")
xy_plane = XYPlane(Origin=center)
center_box = CenterBox(Base=xy_plane, X=panel_2, Y=panel_3, Z=panel_4)
brep = Brep(center_box)

# ---- group: Joint brep
yz_plane = YZPlane(Origin=center)
xz_plane = XZPlane(Origin=center)
# 2. BOX MODELLING
xy_plane_2 = XYPlane(Origin=center)
merge = Merge(Data1=xy_plane_2, Data2=xz_plane, Data3=yz_plane)  # -> simplify(graft(Result))
brep_plane = BrepPlane(Brep=brep, Plane=merge)  # -> Curves, Points
joint_brep = Brep(flatten(brep_plane.Curves))

# ---- group: Rock domain & slope face mesh / Splitting breps
explode_tree = ExplodeTree(Data=graft(joint_brep))  # -> Branch0, Branch1, Branch2
split_brep = SplitBrep(Brep=brep, Cutter=explode_tree.Branch0)
cap_holes = CapHoles(Brep=split_brep)
split_brep_2 = SplitBrep(Brep=cap_holes, Cutter=explode_tree.Branch1)
cap_holes_2 = CapHoles(Brep=split_brep_2)
split_brep_3 = SplitBrep(Brep=cap_holes_2, Cutter=explode_tree.Branch2)
cap_holes_3 = CapHoles(Brep=split_brep_3)  # -> flatten(Brep)
list_item = ListItem(List=cap_holes_3, Index="0", Wrap=True)
brep_to_be_removed = Brep(list_item)
solid_difference = SolidDifference(BrepsA=brep, BrepsB=brep_to_be_removed)
rock_brep = Brep(solid_difference)

# ----
# Convert joint mesh to convex hulled Brep
joint_plane_obj_file_path_2 = FilePath(joint_plane_obj_file_path)
import_obj = ImportOBJ(File=joint_plane_obj_file_path_2, MapYtoZ=False, LastSaveLocalization="neutral,N")  # -> flatten(Geo)
cluster = Cluster_2(joint_mesh_list=import_obj)

# ----
# Joint waviness & aperture
joint_brep_2 = Brep(flatten(cluster))
cluster_2 = Cluster_3(
    joint_brep=joint_brep_2,
    max_amplitude_m=max_waviness_amplitude_m,
    uv_spacing_m=uv_spacing_m,
    min_aperture_m=min_aperture_m,
    max_aperture_m=max_aperture_m)  # -> wavy_joint_solid_2, trimmed_wavy_joint_surface_3

# ----
# Step 4: RENDERING
# Set solid white background:
# In the specific viewport, go to Display Options > in the specific Display Mode > Set ground plane setting off
distance_range_from_camera_and_rock_face = Panel("5 to 10")  # "Distance range from camera and rock face (m)"
perspective_camera_projection = BooleanToggle(True)
number_of_images = Slider(1500, range=0..10000)
camera_lens_length = Panel("50")
subfolder_directory_names = Panel("""\rockmass\
\label\
""")
rhino_viewport_name = Panel("Perspective")
rhino_display_mode = Panel("Wireframe")
image_export_file_directory = Panel("C:\Users\KYC\Downloads\Rv4")
file_format = Panel(".png")
camera_distance_scaling_factor = Slider(6, range=0..10)

# ----
# Step 5: IMAGE EXPORT
# Set the desired width and height of Viewport in Rhino before looping and exporting the images
# NB! Re-writable!
object_visualisation = ValueList({"Rock Mass": 0, "Rock joint annotations": 1}, selected="Rock Mass")
loop_image = BooleanToggle(False)
export_image_nb_set_loop_image_to_true = BooleanToggle(False)

# ----
# 6. CUSTOM PREVIEW SETTINGS
object_visualisation_0_rockmass_1_label = Panel(object_visualisation)
cloud_2 = Cloud(cloud)

# ----
# Output file settings
export_image_boolean = Boolean(export_image_nb_set_loop_image_to_true)
list_item_2 = ListItem(SubfolderDirectoryNames=subfolder_directory_names, Index=object_visualisation_0_rockmass_1_label, Wrap=True)
concatenate = Concatenate(Image_export_file_directory=image_export_file_directory, B=list_item_2, file_format=file_format)
output_file_path = FilePath(concatenate)

# ---- group: Run Rhino command to export viewport
ironpython_2_script = IronPython2Script(file_path=concatenate, run=export_image_boolean)  # -> out, a; inputs viewport_name: String, file_path: String, run: Boolean
# ---------- ironpython_2_script: IronPython ----------
import rhinoscriptsyntax as rs

def capture_viewport(file_path, run, viewport_name):
    if run:
        # Ensure the file path is properly formatted
        formatted_path = '"' + file_path + '"'
        # Activate the specified viewport
        rs.CurrentView(viewport_name)
        # Construct the command string
        command = '-_ViewCaptureToFile {} _Enter'.format(formatted_path)
        # Run the command
        rs.Command(command, True)

# Inputs from Grasshopper
capture_viewport(file_path, run, viewport_name)
# ---------- end ironpython_2_script ----------

# ---- group: RockMass
hide_show_object_preview = HideShowObjectPreview(Visible=invert(object_visualisation_0_rockmass_1_label), AllObjects_Object=cloud_2)

# ---- group: Label
hide_show_object_preview_2 = HideShowObjectPreview(Visible=object_visualisation_0_rockmass_1_label, AllObjects_Object=[custom_preview, custom_preview_lineweights])

# ----
output_file_name = Panel(output_file_path)

# ----
# 5. CAMERA POSITIONING
distance_range_from_camera_and_rock_face_2 = Domain(distance_range_from_camera_and_rock_face)  # "Distance range from camera and rock face (m)"
number_of_images_2 = Integer(number_of_images)
camera_distance_scaling_factor_2 = Number(camera_distance_scaling_factor)

# ----
# 4. ROCK BREP MODELLING
slope_face_mesh_obj_file_path_2 = FilePath(slope_face_mesh_obj_file_path)

# ---- group: Slope face mesh
import_obj_2 = ImportOBJ(File=slope_face_mesh_obj_file_path_2, MapYtoZ=False, LastSaveLocalization="neutral,N")

# ---- group: Convert slope face mesh to extruded closed brep
cluster_3 = Cluster(slope_face_mesh=import_obj_2)

# ----
slope_face_mesh = Mesh(import_obj_2)
rock_brep_2 = Brep(cluster_3)

# ----
# Populate slope face mesh and generate camera locations
slope_face_mesh_2 = Mesh(slope_face_mesh)
populate_geometry = PopulateGeometry(Geometry=slope_face_mesh_2, Count=number_of_images_2, Seed="42")

mesh_closest_point = MeshClosestPoint(Point=populate_geometry, Mesh=slope_face_mesh_2)  # -> Point, Index, Parameter
random = Random(Range=distance_range_from_camera_and_rock_face_2, Number=number_of_images_2, Seed="42")
multiplication = Multiplication(A=random, B=camera_distance_scaling_factor_2)
mesh_eval = MeshEval(Mesh=slope_face_mesh_2, Parameter=mesh_closest_point.Parameter)  # -> Point, Normal, Colour
amplitude = Amplitude(Vector=mesh_eval.Normal, Amplitude=multiplication)
move = Move(Geometry=mesh_eval.Point, Motion=amplitude)  # -> Geometry, Transform
camera_targets = Point(mesh_eval.Point)
camera_locations = Point(move.Geometry)

# ----
# Create wavy joint traces on slope face brep
trimmed_wavy_joint_surface = Brep(cluster_2.trimmed_wavy_joint_surface_3)
rock_brep_3 = Brep(rock_brep_2)
max_aperture_m_2 = Number(max_aperture_m)
min_aperture_m_2 = Number(min_aperture_m)
construct_domain = ConstructDomain(DomainStart=min_aperture_m_2, DomainEnd=max_aperture_m_2)
list_length = ListLength(List=trimmed_wavy_joint_surface)
brep_brep = BrepBrep(BrepA=trimmed_wavy_joint_surface, BrepB=rock_brep_3)  # -> simplify(Curves), Points
random_2 = Random(Range=construct_domain, Number=list_length, Seed="42")

# ----
# 3. JOINT MODELLING
joint_thickness_m = Number(random_2)
joint_trace_curves = Curve(brep_brep.Curves)

# ---- group: Joint traces
joint_trace_curves_2 = Curve(joint_trace_curves)
# 7. PHOTO-SHOOTING & IMAGE EXPORT LOOP
joint_thickness_m_2 = Number(joint_thickness_m)
create_material = CreateMaterial(Diffuse="Black", Specular="Black", Emission="Black", Transparency="0", Shine="0")
custom_preview_lineweights = CustomPreviewLineweights(
    Geometry=joint_trace_curves_2,
    Shader=create_material,
    Thickness=simplify(graft(joint_thickness_m_2)),
    Absolute=invert(False))

# ---- group: Rock brep (white)
create_material_2 = CreateMaterial(Diffuse="White", Specular="White", Emission="White", Transparency="0", Shine="0")
custom_preview = CustomPreview(Geometry=rock_brep_2, Material=create_material_2)

# ---- group: Loop
# Loop & progress
list_length_2 = ListLength(List=camera_locations)
loop_image_boolean = Boolean(loop_image)
invert_boolean = InvertBoolean(Boolean=loop_image_boolean)  # -> Inverted, Number
loop_start = LoopStart(Repeat=list_length_2, Trigger=loop_image_boolean, Data="-1")  # -> port, Counter, Data
addition = Addition(A=loop_start.Data, B="1")
running = Running(
    port=loop_start.port,
    Exit=invert_boolean.Inverted,
    Data=addition,
    TimeOutVal=0,
    pausedState=False,
    state="Constant output")

# ----
check_total_number_of_image_output = Panel(list_length_2)

# ----
# Viewport settings
list_item_3 = ListItem(List=camera_targets, Index=loop_start.Data, Wrap=invert(True))
list_item_4 = ListItem(List=camera_locations, Index=loop_start.Data, Wrap=invert(True))
modify_viewport = ModifyViewport(
    ViewportName=rhino_viewport_name,
    DisplayMode=rhino_display_mode,
    CameraLocation=list_item_4,
    CameraTarget=list_item_3,
    CameraProjection=perspective_camera_projection,
    CameraLensLength=camera_lens_length,
    AnimateRestore=False,
    RestoreFrames=10)

# ---- group: Progress print
multiplication_2 = Multiplication(A=loop_image_boolean, B=running)
concatenate_2 = Concatenate(Fragment_A="Progress: ", B=multiplication_2, A=" of ", Fragment_B=list_length_2)

# ----
image_export_progress = Panel(concatenate_2)

# ==== cluster Cluster
slope_face_mesh = ClusterInput()
slope_face_mesh_2 = Mesh(slope_face_mesh)
mesh_to_polysurface = MeshToPolysurface(Mesh=slope_face_mesh_2, Triangles=False, FaceMerge=False)
bounding_box = BoundingBox(Content=slope_face_mesh_2, Plane=PlaneXY(0, 0, 0))  # -> Box, Box_2
deconstruct_box = DeconstructBox(Box=bounding_box.Box)  # -> Plane, X, Y, Z
evaluate_box = EvaluateBox(Box=bounding_box.Box, UParameter=0.5, VParameter=0.5, WParameter="0")  # -> Plane, Point, Include
deconstruct_domain = DeconstructDomain(Domain=deconstruct_box.Z)  # -> Start, End
expression = Expression(highest=deconstruct_domain.End, lowest=deconstruct_domain.Start, Expression="lowest-highest-1")
unit_z = UnitZ(Factor=expression)
extrude = Extrude(Base=mesh_to_polysurface, Direction=unit_z)
plane_trim_surface = PlaneTrimSurface(Surface=extrude, Plane=evaluate_box.Plane, Flip=False)  # -> Trimmed, Intersected
cap_holes = CapHoles(Brep=plane_trim_surface.Trimmed)
extruded_slope_closed_brep = Brep(cap_holes)
extruded_slope_closed_brep_2 = ClusterOutput(extruded_slope_closed_brep)

# ==== cluster Cluster_2
joint_mesh_list = ClusterInput()
joint_mesh_list_2 = Mesh(joint_mesh_list)
area = Area(Geometry=joint_mesh_list_2)  # -> Area, Centroid
deconstruct_mesh = DeconstructMesh(Mesh=joint_mesh_list_2)  # -> simplify(Vertices), Faces, Colours, Normals
mesh_closest_point = MeshClosestPoint(Point=area.Centroid, Mesh=joint_mesh_list_2)  # -> Point, Index, Parameter
mesh_eval = MeshEval(Mesh=joint_mesh_list_2, Parameter=mesh_closest_point.Parameter)  # -> Point, Normal, Colour
plane_normal = PlaneNormal(Origin=mesh_eval.Point, ZAxis=mesh_eval.Normal)
convex_hull = ConvexHull(Points=deconstruct_mesh.Vertices, Plane=simplify(graft(plane_normal)))  # -> Hull, HullZ, Indices
joint_brep = Brep(convex_hull.Hull)
joint_brep_2 = ClusterOutput(joint_brep)

# ==== cluster Cluster_3
uv_spacing_m = ClusterInput()
max_amplitude_m = ClusterInput()
min_aperture_m = ClusterInput()
joint_brep = ClusterInput()
max_aperture_m = ClusterInput()
uv_spacing_m_2 = Number(uv_spacing_m)
min_aperture_m_2 = Number(min_aperture_m)
max_aperture_m_2 = Number(max_aperture_m)
max_amplitude_m_2 = Number(max_amplitude_m)
joint_brep_2 = Brep(joint_brep)
area = Area(Geometry=joint_brep_2)  # -> Area, Centroid
point_list = PointList(Points=area.Centroid, Size="2")

# ----
# 4. Extrude joint boundary to form cutter
max_amplitude_m_3 = Number(max_amplitude_m_2)
joint_brep_3 = Brep(joint_brep_2)
deconstruct_brep = DeconstructBrep(Brep=joint_brep_3)  # -> Faces, Edges, simplify(Vertices)
number = Number(max_amplitude_m_3)
expression = Expression(a=number, Expression="If(a>0, a*4, 1)")
expression_2 = Expression(a=number, Expression="If(a>0, a*-2, -0.5)")

# ---- group: Randomise aperture values
construct_domain = ConstructDomain(DomainStart=min_aperture_m_2, DomainEnd=max_aperture_m_2)

# ----
# 3. Create wavy rectangular surface
max_amplitude_m_4 = Number(max_amplitude_m_2)
negative = Negative(Value=max_amplitude_m_4)
construct_domain_2 = ConstructDomain(DomainStart=negative, DomainEnd=max_amplitude_m_4)

# ----
# 1. Create rectangle surface and distribute seed points
joint_brep_4 = Brep(joint_brep_2)
is_planar = IsPlanar(Surface=joint_brep_4, Interior=True)  # -> Planar, Plane
bounding_rectangle = BoundingRectangle(Geometry=simplify(graft(joint_brep_4)), Plane=simplify(graft(is_planar.Plane)), Axis=0, Slide=0, Union=invert(True))  # -> simplify(Bounding), simplify(DimensionX), simplify(DimensionY)
joint_plane = Plane(is_planar.Plane)

joint_plane_2 = Plane(joint_plane)
deconstruct_plane = DeconstructPlane(Plane=joint_plane_2)  # -> Origin, XAxis, YAxis, simplify(graft(ZAxis))
convex_hull = ConvexHull(Points=deconstruct_brep.Vertices, Plane=simplify(graft(joint_plane_2)))  # -> Hull, HullZ, Indices
amplitude = Amplitude(Vector=simplify(graft(deconstruct_plane.ZAxis)), Amplitude=expression_2)
amplitude_2 = Amplitude(Vector=simplify(graft(deconstruct_plane.ZAxis)), Amplitude=expression)
move = Move(Geometry=simplify(graft(convex_hull.Hull)), Motion=amplitude)  # -> Geometry, Transform
extrude = Extrude(Base=simplify(graft(move.Geometry)), Direction=amplitude_2)
extruded_joint_boundary = Brep(extrude)

# ---- group: Randomise aperture values (continued)
list_length = ListLength(List=joint_brep_4)
random = Random(Range=construct_domain, Number=list_length, Seed="42")

# ----
expression_3 = Expression(x=flatten(bounding_rectangle.DimensionX), spacing=uv_spacing_m_2, Expression="x/spacing")
expression_4 = Expression(x=flatten(bounding_rectangle.DimensionY), spacing=uv_spacing_m_2, Expression="x/spacing")

divide_surface = DivideSurface(Surface=bounding_rectangle.Bounding, UCount=simplify(graft(expression_3)), VCount=simplify(graft(expression_4)))  # -> Points, Normals, Parameters

# ----
# 5. Trim rectangular wavy surface with joint boundary
cutter = Brep(extruded_joint_boundary)
cap_holes = CapHoles(Brep=cutter)

# ----
# 6. Extrude trimmed wavy surface with aperture to closed brep
joint_plane_3 = Plane(is_planar.Plane)
deconstruct_plane_2 = DeconstructPlane(Plane=joint_plane_3)  # -> Origin, XAxis, YAxis, ZAxis
amplitude_3 = Amplitude(Vector=deconstruct_plane_2.ZAxis, Amplitude=random)

rectangle_joint_brep = Brep(bounding_rectangle.Bounding)
trim_tree = TrimTree(Tree=divide_surface.Points, Depth=1)  # -> simplify(Tree)
trim_tree_2 = TrimTree(Tree=divide_surface.Normals, Depth=1)  # -> simplify(Tree)
list_length_2 = ListLength(List=trim_tree)
random_2 = Random(Range=construct_domain_2, Number=list_length_2, Seed="42")  # -> simplify(Random)
amplitude_4 = Amplitude(Vector=trim_tree_2, Amplitude=random_2)
addition = Addition(A=expression_3, B="1")  # -> simplify(graft(Result))
move_2 = Move(Geometry=trim_tree, Motion=amplitude_4)  # -> Geometry, Transform

# ---- group: Only deform surface if tree branch not empty
tree_statistics = TreeStatistics(Tree=move_2.Geometry)  # -> Paths, Length, Count
tree_branch = TreeBranch(Tree=addition, Path=tree_statistics.Paths, MaintainPaths=True)

# ---- group: surface too small for UV division
list_indices = ListIndices(List=joint_brep_4)
deconstruct_path = DeconstructPath(Branch=tree_statistics.Paths)  # -> flatten(Indices)
cull_index = CullIndex(List=list_indices, Indices=deconstruct_path, Wrap=True)
tree_branch_2 = TreeBranch(Tree=bounding_rectangle.Bounding, Path=cull_index, MaintainPaths=True)

# ----
surface_from_points = SurfaceFromPoints(Points=move_2.Geometry, UCount=tree_branch, Interpolate=invert(False))

merge = Merge(Data1=surface_from_points, Data2=tree_branch_2)

wavy_rect_surface = Brep(merge)

wavy_rect_surface_2 = Brep(wavy_rect_surface)
split_brep = SplitBrep(Brep=wavy_rect_surface_2, Cutter=cutter)  # -> simplify(Result)
area_2 = Area(Geometry=split_brep)  # -> Area, Centroid
point_in_brep = PointInBrep(Brep=cap_holes, Point=area_2.Centroid, Strict=True)
cull_pattern = CullPattern(List=split_brep, CullPattern=point_in_brep)
trimmed_wavy_joint_surface = Brep(flatten(cull_pattern))

trimmed_wavy_joint_surface_2 = Brep(flatten(trimmed_wavy_joint_surface))
extrude_2 = Extrude(Base=flatten(trimmed_wavy_joint_surface_2), Direction=amplitude_3)
wavy_joint_solid = Brep(extrude_2)

trimmed_wavy_joint_surface_3 = ClusterOutput(trimmed_wavy_joint_surface_2)
wavy_joint_solid_2 = ClusterOutput(wavy_joint_solid)
